# Grasshopper definition Sunspace-Design-Tool.gh (Grasshopper 1.0.7)
# plug-ins: CORE.Grasshopper.Colibri

# Orientation
# Geometry
# a) Directories & Climate Data
# 1
# Results Saving Directory
panel = Panel("C:\Users\amomenae\Pictures\FinalSimulationCooling")
# 2
# EPW File Path
# 3
puerto_montt = Panel("C:\Users\amomenae\University of Oregon Dropbox\Atousa Momenaei\07 Chile passive heating\04 Weather files\epw\CHL_LL_Puerto.Montt-El.Tepual.Intl.AP.857990_TMYx.2007-2021\CHL_LL_Puerto.Montt-El.Tepual.Intl.AP.857990_TMYx.2007-2021.epw")

# ----
# Heating & cooling seasons
heating_season_start_month = ValueList({"Jan": "1", "Feb": "2", "Mar": "3", "Apr": "4", "May": "5", "Jun": "6", "Jul": "7", "Aug": "8", "Sep": "9", "Oct": "10", "Nov": "11", "Dec": "12"}, selected="Apr")
# Site shading
# (degrees above the horizon)
# 4
heating_season_end_month = ValueList({"Jan": "1", "Feb": "2", "Mar": "3", "Apr": "4", "May": "5", "Jun": "6", "Jul": "7", "Aug": "8", "Sep": "9", "Oct": "10", "Nov": "11", "Dec": "12"}, selected="Sep")
coolin_season_start_month = ValueList({"Jan": "1", "Feb": "2", "Mar": "3", "Apr": "4", "May": "5", "Jun": "6", "Jul": "7", "Aug": "8", "Sep": "9", "Oct": "10", "Nov": "11", "Dec": "12"}, selected="Oct")
cooling_season_end_month = ValueList({"Jan": "1", "Feb": "2", "Mar": "3", "Apr": "4", "May": "5", "Jun": "6", "Jul": "7", "Aug": "8", "Sep": "9", "Oct": "10", "Nov": "11", "Dec": "12"}, selected="Mar")

# ----
# b) Classroom Attributes
# 1
# Build Classroom Geometry
slope_direction = ValueList({"Norh-South": "0", "East-West": "1"}, selected="Norh-South")

# ----
# 2
# Add Aperture
north_wwr = ValueList({"0%": "0", "10%": "0.1", "20%": "0.2", "30%": "0.3", "40%": "0.4", "50%": "0.5", "60%": "0.6", "70%": "0.7", "80%": "0.8", "90%": "0.9"}, selected="60%")
east_wwr = ValueList({"0%": "0", "10%": "0.1", "20%": "0.2", "30%": "0.3", "40%": "0.4", "50%": "0.5", "60%": "0.6", "70%": "0.7", "80%": "0.8", "90%": "0.9"}, selected="0%")
south_wwr = ValueList({"0%": "0", "10%": "0.1", "20%": "0.2", "30%": "0.3", "40%": "0.4", "50%": "0.5", "60%": "0.6", "70%": "0.7", "80%": "0.8", "90%": "0.9"}, selected="0%")
west_wwr = ValueList({"0%": "0", "10%": "0.1", "20%": "0.2", "30%": "0.3", "40%": "0.4", "50%": "0.5", "60%": "0.6", "70%": "0.7", "80%": "0.8", "90%": "0.9"}, selected="0%")

value_list = ValueList({"With summer shading": "1", "Without summer shading": "0"}, selected="With summer shading")
# 4
# Set the run
value_list_2 = ValueList({"Heating Load": "0", "Cooling Load": "1"}, selected="Heating Load")

# ----
# 4
# Add Materials
floor_construction = ValueList({"Typical Insulated 6in Slab Floor", "Typical Insulated 8in Slab Floor", "Typical Insulated Exterior Mass Floor", "Typical Insulated Exterior Mass Floor-R16", "Typical Insulated Steel Framed Exterior Floor", "Typical Insulated Steel Framed Exterior Floor-R20", "Typical Insulated Wood Framed Exterior Floor", "Typical Insulated Wood Framed Exterior Floor-R20", "Typical Insulated Wood Framed Exterior Floor-R31", "Typical Insulated Wood Framed Exterior Floor-R38", "Typical Insulated Wood Framed Exterior Floor-R4", "Typical Interior Floor", "Typical Interior Slab Floor", "Typical Uncarpeted 4in Slab Floor", "Typical Uncarpeted 6in Slab Floor", "Typical Uninsulated 6in Slab Floor", "Typical Uninsulated 8in Slab Floor"}, selected="Typical Uninsulated 6in Slab Floor")
roof_construction = ValueList({"Typical Insulated Metal Building Roof", "Typical Insulated Metal Building Roof - Highly Reflective", "Typical Insulated Metal Building Roof - Highly Reflective-R16", "Typical Insulated Metal Building Roof - Highly Reflective-R25", "Typical Insulated Metal Building Roof-R10", "Typical Insulated Metal Building Roof-R12", "Typical Insulated Metal Building Roof-R14", "Typical Insulated Metal Building Roof-R16", "Typical Insulated Metal Building Roof-R19", "Typical Insulated Metal Building Roof-R21", "Typical Insulated Metal Building Roof-R23", "Typical Insulated Metal Building Roof-R25", "Typical Insulated Metal Building Roof-R28", "Typical Insulated Metal Building Roof-R29", "Typical Insulated Metal Building Roof-R33", "Typical Insulated Metal Building Roof-R35", "Typical Insulated Metal Building Roof-R39", "Typical Uninsulated Metal Building Roof", "Typical Uninsulated Metal Building Roof - Highly Reflective", "Typical Uninsulated Metal Roof Attic Roof", "Typical Uninsulated Wood Joist Attic Roof", "Typical Mass RoofR-5.6"}, selected="Typical Mass RoofR-5.6")
wall_construction = ValueList({"Typical Uninsulated Exterior Mass Wall", "Typical Uninsulated Interior Wall", "Typical Uninsulated Metal Building Wall", "Typical Uninsulated Steel Framed Exterior Wall", "Typical Insulated Exterior Mass Wall", "Typical Insulated Metal Building Wall", "Typical Insulated Steel Framed Exterior Wall", "Typical Insulated Wood Framed Exterior Wall"}, selected="Typical Uninsulated Exterior Mass Wall")

# ---- group: window
# d) Simulation Settings
panel_2 = Panel("0.899")
windowmat = HBWindowMaterial(name="clear 3mm", u_factor="5.913", shgc="0.861", t_vis=panel_2)  # -> mat; plug-in component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
windowconstr = HBWindowConstruction(materials=windowmat)  # -> constr; plug-in component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

# ----
# 1
# Add ACH
# Enter Heating setpoint
# Enter Cooling setpoint
panel_3 = Panel("18")
# 3
# Add occupancy
panel_4 = Panel("26")

# ----
# Enter People/area
panel_5 = Panel("0.83")

# ----
# 3
# Select interior walls
interior_walls = ValueList({"North": "3", "South": "2", "East": "1", "West": "0"}, selected=["South", "West"])
do_the_adjacent_rooms_have_sunspaces = ValueList({"Yes": "1", "No": "0"}, selected="Yes")

# ----
# Ridge's height (m)
# Enter the same value as eave if roof is flat
panel_6 = Panel("3")

# ----
# Eave's Height (m)
panel_7 = Panel("3")

# ----
# Room's lenght (m)
# South-North direction
panel_8 = Panel("6")

# ----
# Room's width (m)
# East-West direction
panel_9 = Panel("9")

# ---- group: 1
toggle = BooleanToggle(True)

# ----
# 2
# Add setpoints
# Enter sunspace ACH
# Enter classroom ACH
panel_10 = Panel("0.5")

# ---- group: 2
boolean_toggle = BooleanToggle(False)

# ----
# Rhino viewport
panel_11 = Panel("Perspective")

# ---- group: 3
button = Button()

# ----
# c) Sunspace Configurations
# Geometry
# 1
# Orientation
sunspace_orientatio = ValueList({"South": 0, "East": 1, "North": 2, "West": 3}, selected="North")
# Roof tilts
# to be tested
# 2
sunspace_roof_angle = ValueList({"0°": "0", "5°": "5", "10°": "10", "15°": "15", "20°": "20", "25°": "25", "30°": "30", "35°": "35", "40°": "40"}, selected=["0°", "15°", "30°"])
# Wall depths
# to be tested
# 3
sunspace_depth = ValueList({"0 m": "0", "0.5 m": "0.5", "1 m": "1", "1.5 m": "1.5", "2 m": "2", "2.5 m": "2.5", "3 m": "3"}, selected=["1 m", "2 m", "3 m"])
# 4
# Skylight WWR
# to be tested
skylight_wwr = ValueList({"10%": "0.1", "20%": "0.2", "30%": "0.3", "40%": "0.4", "50%": "0.5", "60%": "0.6", "70%": "0.7", "80%": "0.8", "90%": "0.9"}, selected=["30%", "60%", "90%"])
# Exterior Wall WWR
# to be tested
# 5
exterior_wall_wwr = ValueList({"10%": "0.1", "20%": "0.2", "30%": "0.3", "40%": "0.4", "50%": "0.5", "60%": "0.6", "70%": "0.7", "80%": "0.8", "90%": "0.9"}, selected=["30%", "60%", "90%"])
# Opaque constructions
# to be tested
# 9
exterior_wall_construction = ValueList({"Uninsulated Exterior Mass Wall-R1.5": "Typical Uninsulated Exterior Mass Wall", "Uninsulated Steel Framed Exterior Wall-R1": "Typical Uninsulated Steel Framed Exterior Wall", "Insulated Exterior Mass Wall-R5": "Typical Insulated Exterior Mass Wall-R5", "Insulated Exterior Mass Wall-R9": "Typical Insulated Exterior Mass Wall-R9", "Insulated Exterior Mass Wall-R13": "Typical Insulated Exterior Mass Wall-R13", "Insulated Exterior Mass Wall-R17": "Typical Insulated Exterior Mass Wall-R17", "Insulated Exterior Mass Wall-R21": "Typical Insulated Exterior Mass Wall-R21", "Insulated Steel Framed Exterior Wall-R5": "Typical Insulated Steel Framed Exterior Wall-R5", "Insulated Steel Framed Exterior Wall-R9": "Typical Insulated Steel Framed Exterior Wall-R9", "Insulated Steel Framed Exterior Wall-R13": "Typical Insulated Steel Framed Exterior Wall-R13", "Insulated Steel Framed Exterior Wall-R16": "Typical Insulated Steel Framed Exterior Wall-R16", "Insulated Steel Framed Exterior Wall-R21": "Typical Insulated Steel Framed Exterior Wall-R21", "Insulated Steel Framed Exterior Wall-R23": "Typical Insulated Steel Framed Exterior Wall-R23", "Insulated Steel Framed Exterior Wall-R28": "Typical Insulated Steel Framed Exterior Wall-R28", "Insulated Wood Framed Exterior Wall-R5": "Typical Insulated Wood Framed Exterior Wall-R5", "Insulated Wood Framed Exterior Wall-R7": "Typical Insulated Wood Framed Exterior Wall-R7", "Insulated Wood Framed Exterior Wall-R13": "Typical Insulated Wood Framed Exterior Wall-R13", "Insulated Wood Framed Exterior Wall-R18": "Typical Insulated Wood Framed Exterior Wall-R18", "Insulated Wood Framed Exterior Wall-R23": "Typical Insulated Wood Framed Exterior Wall-R23", "Insulated Wood Framed Exterior Wall-R28": "Typical Insulated Wood Framed Exterior Wall-R28", "Insulated Wood Framed Exterior Wall-R32": "Typical Insulated Wood Framed Exterior Wall-R32"}, selected=["Uninsulated Exterior Mass Wall-R1.5", "Insulated Exterior Mass Wall-R17"])
# Movable insulations
# to be tested
# 8
movable_insulation_material = ValueList({"No movable insulation": "No_Movable_insulation", "Reflective Bubble_wrap": "Reflective_Bubble_wrap", "EPS100 Polystyrene Insulation Board": "EPS100_Polystyrene_Insulation_Board", "LUXOUS 1147 FR": "LUXOUS_1147_FR"}, selected=["No movable insulation", "EPS100 Polystyrene Insulation Board", "LUXOUS 1147 FR"])
# Floor constructions
# to be tested
# 10
floor_construction_2 = ValueList({"Uninsulated 6in Slab Floor-R0.4": "Typical Uninsulated 6in Slab Floor", "Uninsulated 8in Slab Floor-R0.5": "Typical Uninsulated 8in Slab Floor", "Insulated Exterior Mass Floor-R4": "Typical Insulated Exterior Mass Floor-R4", "Insulated Exterior Mass Floor-R8": "Typical Insulated Exterior Mass Floor-R8", "Insulated Exterior Mass Floor-R10": "Typical Insulated Exterior Mass Floor-R10", "Insulated Exterior Mass Floor-R12": "Typical Insulated Exterior Mass Floor-R12", "Insulated Exterior Mass Floor-R14": "Typical Insulated Exterior Mass Floor-R14", "Insulated Exterior Mass Floor-R16": "Typical Insulated Exterior Mass Floor-R16", "Insulated Exterior Mass Floor-R18": "Typical Insulated Exterior Mass Floor-R18", "Insulated Exterior Mass Floor-R20": "Typical Insulated Exterior Mass Floor-R20", "Insulated Exterior Mass Floor-R24": "Typical Insulated Exterior Mass Floor-R24", "Insulated Exterior Mass Floor-R27": "Typical Insulated Exterior Mass Floor-R27"}, selected=["Uninsulated 6in Slab Floor-R0.4", "Insulated Exterior Mass Floor-R8"])
# Materials
# Window constructions
# to be tested
# 6
window_construction = ValueList({"clear 3mm", "clear 6mm", "Acrylic 3mm", "Acrylic 6mm", "Polyc 6mm twin wall": "Polyc 6mm twin", "Polyc 8mm twin wall": "Polyc 8mm twin", "Polyc 10mm twin wall": "Polyc 10mm twin"}, selected=["clear 3mm", "Polyc 6mm twin wall"])
# Skylight constructions
# to be tested
# 7
skylight_construction = ValueList({"clear 3mm", "clear 6mm", "Acrylic 3mm", "Acrylic 6mm", "Polyc 6mm twin wall": "Polyc 6mm twin", "Polyc 8mm twin wall": "Polyc 8mm twin", "Polyc 10mm twin wall": "Polyc 10mm twin"}, selected=["clear 3mm", "Polyc 6mm twin wall"])

# ----
# Keep this part unchanged
cluster = Cluster(
    ep_constr_2=wall_construction,
    ep_constr_3=wall_construction,
    X=panel_9,
    Y=panel_8,
    indices=interior_walls,
    ep_constr_4=wall_construction,
    index_2=slope_direction,
    index_3=slope_direction,
    factor=panel_7,
    index_5=slope_direction,
    ep_constr_5=wall_construction,
    index=slope_direction,
    Panel=[panel_9, panel_8],
    A=panel_6,
    index_4=slope_direction,
    B=panel_7,
    north=north_wwr,
    east_2=east_wwr,
    south=south_wwr,
    west_2=west_wwr,
    ep_constr=windowconstr,
    values=panel_3,
    values_2=panel_4,
    ep_constr_6=wall_construction,
    Panel_2=coolin_season_start_month,
    Panel_3=cooling_season_end_month,
    gate=do_the_adjacent_rooms_have_sunspaces,
    degrees="10",
    remotefly=button,
    X_2=panel_9,
    index_6=sunspace_orientatio,
    Y_2=panel_8,
    Panel_4=heating_season_start_month,
    A_2=sunspace_orientatio,
    floor_const=floor_construction_2,
    window_const=window_construction,
    skylight_wwr=skylight_wwr,
    skylight_const=skylight_construction,
    exterior_wall_const=exterior_wall_construction,
    sunspace_depth=sunspace_depth,
    exterior_wall_wwr=exterior_wall_wwr,
    set_a_2=interior_walls,
    roof_angle=sunspace_roof_angle,
    insulation_material=movable_insulation_material,
    set_a=interior_walls,
    Panel_5=heating_season_end_month,
    B_3=value_list_2,
    gate_3=value_list_2,
    factor_2=panel_7,
    epw_file=puerto_montt,
    write=toggle,
    run=toggle,
    x=panel_10,
    x_2="2",
    gate_2=value_list_2,
    first_number=value_list_2,
    A_3=value_list_2,
    A_5=value_list_2,
    constr=floor_construction,
    B_2=value_list,
    x_3=panel_5,
    A_4=value_list_2,
    member=roof_construction)  # -> adj_rooms, unique_name, inputs, s_0, s_0_2, mesh_5, mesh_6, mesh_7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

panel_12 = Panel(cluster.unique_name)
colibri_outputs = ColibriOutputs(
    Heating_load_kWh_m2=flatten(cluster.s_0_2),
    Solar_gain_kWh=flatten(cluster.item_1),
    Cooling_load_kWh_m2=flatten(cluster.s_0))
colibri_image_setting = ColibriImageSetting(ImageSaveAsName=panel_12, RhinoViewNames=panel_11, Width=600, Height=600)
colibri_aggregator = ColibriAggregator(
    Folder=panel,
    Inputs=cluster.inputs,
    Outputs=colibri_outputs,
    ImageSetting=colibri_image_setting,
    Write=boolean_toggle,
    recordingMode=0)

# ---- group: Result
# Result
panel_13 = Panel(colibri_outputs)

# ---- group: Output colors
vizwiref = HBVisualizeWireframe(hb_objs=flatten(cluster.adj_rooms))  # -> geo; plug-in component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
mcol = MeshColours(Mesh=[cluster.mesh_5, cluster.mesh_6, cluster.mesh_7], Colours=cluster.colour_3)
mcol_2 = MeshColours(Mesh=cluster.mesh_8, Colours=cluster.colour_4)
linear_dimension = LinearDimension(Line=cluster.geometry_3, PointA=cluster.end_2, PointB=cluster.start_2, Text="{0:0.00}", Size=cluster.number_slider_4)
linear_dimension_2 = LinearDimension(Line=cluster.geometry_2, PointA=cluster.start_3, PointB=cluster.end_3, Text="{0:0.00}", Size=cluster.number_slider_4)
linear_dimension_3 = LinearDimension(Line=cluster.geometry, PointA=cluster.start, PointB=cluster.end, Text="{0:0.00}", Size=cluster.number_slider_4)

# ==== cluster Cluster
factor = ClusterInput()
unit_z = UnitZ(Factor=factor)
X = ClusterInput()
Y = ClusterInput()

# ---- group: school geometry
xy = XYPlane(Origin=Point(0, 0, 0))
rectangle = Rectangle(Plane=xy, XSize=X, YSize=Y, Radius=0)  # -> Rectangle, Length

# ----
extrude = Extrude(Base=rectangle.Rectangle, Direction=unit_z)
floor_const = ClusterInput()
window_const = ClusterInput()
skylight_wwr = ClusterInput()
skylight_const = ClusterInput()
exterior_wall_const = ClusterInput()
sunspace_depth = ClusterInput()
exterior_wall_wwr = ClusterInput()
roof_angle = ClusterInput()
insulation_material = ClusterInput()
cap_holes = CapHoles(Brep=extrude)
remotefly = ClusterInput()
floor_const_2 = Panel(floor_const)
window_const_2 = Panel(window_const)
skylight_wwr_2 = Panel(skylight_wwr)
skylight_const_2 = Panel(skylight_const)
exterior_wall_const_2 = Panel(exterior_wall_const)
sunspace_depth_2 = Panel(sunspace_depth)
roof_angle_2 = Panel(roof_angle)
exterior_wall_wwr_2 = Panel(exterior_wall_wwr)
insulation_material_2 = Panel(insulation_material)
list_item = ListItem(List=cap_holes, Index=0, Wrap=True)
colibri_inputs_iterator = ColibriInputsIterator(
    RemoteFly=remotefly,
    Roof_angle=roof_angle_2,
    Sunspace_depth=sunspace_depth_2,
    Skylight_WWR=skylight_wwr_2,
    Exterior_wall_WWR=exterior_wall_wwr_2,
    Floor_const=floor_const_2,
    Window_const=window_const_2,
    Skylight_const=skylight_const_2,
    Exterior_wall_const=exterior_wall_const_2,
    Insulation_material=insulation_material_2,
    ignoreAllWarningMsg=True)  # -> Unique_Name, Inputs, Roof_angle, Sunspace_depth, Skylight_WWR, Exterior_wall_WWR, Floor_const, Window_const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
deconstruct_brep = DeconstructBrep(Brep=list_item)  # -> Faces, Edges, Vertices
explode = Explode(Curve=rectangle.Rectangle, Recursive=True)  # -> Segments, Vertices
list_item_2 = ListItem(List=deconstruct_brep.Faces, Index="-2", Wrap=True)
unique_name = ClusterOutput(colibri_inputs_iterator.Unique_Name)
inputs = ClusterOutput(colibri_inputs_iterator.Inputs)
A = ClusterInput()
B = ClusterInput()
iso_curve = IsoCurve(Surface=reparameterize(list_item_2), UVPoint="{0.5, 0.5, 0}")  # -> UIsocurve, VIsocurve
list_item_3 = ListItem(List=explode.Segments, Index=Slider(2, range=0..10), Wrap=True)
subtraction = Subtraction(A=A, B=B)
index = ClusterInput()
list_item_4 = ListItem(List=[iso_curve.UIsocurve, iso_curve.VIsocurve], Index=index, Wrap=True)
iso_curve_2 = IsoCurve(Surface=reparameterize(list_item_2), UVPoint="{0, 0, 0}")  # -> UIsocurve, VIsocurve
iso_curve_3 = IsoCurve(Surface=reparameterize(list_item_2), UVPoint="{1, 1, 0}")  # -> UIsocurve, VIsocurve
unit_z_2 = UnitZ(Factor=subtraction)
index_2 = ClusterInput()
index_3 = ClusterInput()
move = Move(Geometry=list_item_4, Motion=unit_z_2)  # -> Geometry, Transform
curve_middle = CurveMiddle(Curve=list_item_3)
list_item_5 = ListItem(List=[iso_curve_2.UIsocurve, iso_curve_2.VIsocurve], Index=index_2, Wrap=True)
list_item_6 = ListItem(List=[iso_curve_3.UIsocurve, iso_curve_3.VIsocurve], Index=index_3, Wrap=True)
xy_2 = XYPlane(Origin=Point(0, 0, 0))
X_2 = ClusterInput()
Y_2 = ClusterInput()
end_points = EndPoints(Curve=[list_item_5, move.Geometry, list_item_6])  # -> Start, End
larger_than = LargerThan(FirstNumber=colibri_inputs_iterator.Sunspace_depth, SecondNumber=0)  # -> LargerThan, OrEqualTo
panel = Panel(ClusterInput())
rectangle_2 = Rectangle(Plane=xy_2, XSize=X_2, YSize=Y_2, Radius=0)  # -> Rectangle, Length
panel_2 = Panel("""{1, 0, 0}
{0, 1, 0}""")
point = Point(end_points.Start)
polyline = PolyLine(Vertices=point, Closed=False)
xy_plane = XYPlane(Origin=Point(0, 0, 0))
explode_2 = Explode(Curve=rectangle_2.Rectangle, Recursive=True)  # -> Segments, Vertices
cosine = Cosine(Value=degrees(colibri_inputs_iterator.Roof_angle))
index_4 = ClusterInput()
index_5 = ClusterInput()
stream_filter = StreamFilter(Gate=larger_than.LargerThan, Stream0="0", Stream1=".005")
project = Project(Geometry=polyline, Plane=xy_plane)  # -> Geometry, Transform
index_6 = ClusterInput()
list_item_7 = ListItem(List=panel, Index=index_4, Wrap=True)
list_item_8 = ListItem(List=panel_2, Index=index_5, Wrap=True)
list_item_9 = ListItem(List=explode_2.Segments, Index=index_6, Wrap=True)
addition = Addition(A=colibri_inputs_iterator.Sunspace_depth, B=stream_filter)
division = Division(A=addition, B=cosine)
amplitude = Amplitude(Vector=list_item_8, Amplitude=list_item_7)
ruled_surface = RuledSurface(CurveA=project.Geometry, CurveB=polyline)
offset_curve_loose = OffsetCurveLoose(Curve=list_item_9, Distance=division)
extrude_2 = Extrude(Base=ruled_surface, Direction=amplitude)
deconstruct_brep_2 = DeconstructBrep(Brep=extrude_2)  # -> Faces, Edges, Vertices

area = Area(Geometry=deconstruct_brep_2.Faces)  # -> Area, Centroid
deconstruct = Deconstruct(Point=area.Centroid)  # -> XComponent, YComponent, flatten(ZComponent)
sort_list = SortList(Keys=deconstruct.ZComponent, ValuesValuesA=flatten(deconstruct_brep_2.Faces))  # -> Keys, ValuesValuesA
list_item_10 = ListItem(List=sort_list.Keys, Index="-1", Wrap=True)
list_item_11 = ListItem(List=sort_list.Keys, Index="0", Wrap=True)
member_index = MemberIndex(Set=deconstruct.ZComponent, Member=list_item_10)  # -> Index, Count
member_index_2 = MemberIndex(Set=deconstruct.ZComponent, Member=list_item_11)  # -> Index, Count
list_item_12 = ListItem(List=deconstruct_brep_2.Faces, Index=member_index.Index, Wrap=True)
list_item_13 = ListItem(List=deconstruct_brep_2.Faces, Index=member_index_2.Index, Wrap=True)
cull_index = CullIndex(List=area.Centroid, Indices=[member_index.Index, member_index_2.Index], Wrap=True)
cull_index_2 = CullIndex(List=deconstruct_brep_2.Faces, Indices=[member_index.Index, member_index_2.Index], Wrap=True)
deconstruct_2 = Deconstruct(Point=cull_index)  # -> XComponent, YComponent, flatten(ZComponent)
sort_list_2 = SortList(Keys=deconstruct_2.XComponent, ValuesValuesA=flatten(deconstruct_2.XComponent))  # -> Keys, ValuesValuesA
sort_list_3 = SortList(Keys=deconstruct_2.YComponent, ValuesValuesA=flatten(deconstruct_2.YComponent))  # -> Keys, ValuesValuesA
list_item_14 = ListItem(List=sort_list_2.ValuesValuesA, Index="0", Wrap=True)
list_item_15 = ListItem(List=sort_list_2.ValuesValuesA, Index="-1", Wrap=True)
list_item_16 = ListItem(List=sort_list_3.ValuesValuesA, Index="0", Wrap=True)
list_item_17 = ListItem(List=sort_list_3.ValuesValuesA, Index="-1", Wrap=True)
member_index_3 = MemberIndex(Set=deconstruct_2.XComponent, Member=list_item_14)  # -> Index, Count
member_index_4 = MemberIndex(Set=deconstruct_2.XComponent, Member=list_item_15)  # -> Index, Count
member_index_5 = MemberIndex(Set=deconstruct_2.YComponent, Member=list_item_16)  # -> Index, Count
member_index_6 = MemberIndex(Set=deconstruct_2.YComponent, Member=list_item_17)  # -> Index, Count
west = ListItem(List=cull_index_2, Index=member_index_3.Index, Wrap=True)
east = ListItem(List=cull_index_2, Index=member_index_4.Index, Wrap=True)

offset_curve_loose_2 = OffsetCurveLoose(Curve=list_item_9, Distance=addition)
factor_2 = ClusterInput()
ruled_surface_2 = RuledSurface(CurveA=list_item_9, CurveB=offset_curve_loose)
unit_z_3 = UnitZ(Factor=factor_2)
north = ClusterInput()
east_2 = ClusterInput()
south = ClusterInput()
west_2 = ClusterInput()
flip = Flip(Surface=ruled_surface_2)  # -> Surface, Result
roomsolid = HBRoomFromSolid(geo=flatten(extrude_2), conditioned=True)  # -> out, rooms; plug-in component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
facparam = HBFacadeParameters(north=north, east=east_2, south=south, west=west_2)  # -> fac_par; plug-in component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
move_2 = Move(Geometry=flip.Surface, Motion=unit_z_3)  # -> Geometry, Transform
move_3 = Move(Geometry=list_item_9, Motion=unit_z_3)  # -> Geometry, Transform
ruled_surface_3 = RuledSurface(CurveA=list_item_9, CurveB=offset_curve_loose_2)
rotate_axis = RotateAxis(Geometry=move_2.Geometry, Angle=degrees(colibri_inputs_iterator.Roof_angle), Axis=move_3.Geometry)  # -> Geometry, Transform
aperturesbyratio = HBAperturesByRatio(hb_objs=flatten(roomsolid.rooms), ratio=facparam)  # -> out, hb_objs; plug-in component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
loft = Loft(
    Curves=[ruled_surface_3, rotate_axis.Geometry],
    Options={Adjust=False, Closed=False, LoftEnds=0, LoftSimp=0, LoftType=0, Rebuild=10, Refit=0.01})
decnstrobj = HBDeconstructObject(hb_obj=aperturesbyratio.hb_objs)  # -> faces, apertures, doors, shades; plug-in component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

panel_3 = Panel("""clear 3mm
clear 6mm
Acrylic 3mm
Acrylic 6mm
Polyc 6mm twin
Polyc 8mm twin
Polyc 10mm twin""")
member_index_7 = MemberIndex(Set=panel_3, Member=colibri_inputs_iterator.Window_const)  # -> Index, Count
windowmat = HBWindowMaterial(name="clear 3mm", u_factor="5.913", shgc="0.861", t_vis="0.899")  # -> mat; plug-in component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
windowmat_2 = HBWindowMaterial(name="clear 6mm", u_factor="5.818", shgc="0.941", t_vis="0.818")  # -> mat; plug-in component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
windowmat_3 = HBWindowMaterial(name="Acrylic 3mm", u_factor="5.679", shgc="0.875", t_vis="0.923")  # -> mat; plug-in component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
windowmat_4 = HBWindowMaterial(name="Acrylic 6mm", u_factor="5.224", shgc="0.987", t_vis="0.859")  # -> mat; plug-in component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
windowmat_5 = HBWindowMaterial(name="Polyc 6mm twin", u_factor="3.46", shgc="0.8", t_vis="0.8")  # -> mat; plug-in component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
windowmat_6 = HBWindowMaterial(name="Polyc 8mm twin", u_factor="3.293", shgc="0.82", t_vis="0.81")  # -> mat; plug-in component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
windowmat_7 = HBWindowMaterial(name="Polic 10mm twin", u_factor="2.952", shgc="0.82", t_vis="0.82")  # -> mat; plug-in component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
merge = Merge(
    Data1="clear 3mm",
    Data2="clear 6mm",
    Data3="Acrylic 3mm",
    Data4="Acrylic 6mm",
    Data5="Polyc 6mm twin",
    Data6="Polyc 8mm twin",
    Data7="Polic 10mm twin")
merge_2 = Merge(
    Data1=windowmat,
    Data2=windowmat_2,
    Data3=windowmat_3,
    Data4=windowmat_4,
    Data5=windowmat_5,
    Data6=windowmat_6,
    Data7=windowmat_7)
member_index_8 = MemberIndex(Set=panel_3, Member=colibri_inputs_iterator.Skylight_const)  # -> Index, Count
panel_4 = Panel(merge)
list_item_18 = ListItem(List=panel_4, Index=member_index_7.Index, Wrap=True)
list_item_19 = ListItem(List=merge_2, Index=member_index_7.Index, Wrap=True)
list_item_20 = ListItem(List=panel_4, Index=member_index_8.Index, Wrap=True)
list_item_21 = ListItem(List=merge_2, Index=member_index_8.Index, Wrap=True)
windowconstr = HBWindowConstruction(name=list_item_20, materials=list_item_21)  # -> constr; plug-in component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
windowconstr_2 = HBWindowConstruction(name=list_item_18, materials=list_item_19)  # -> constr; plug-in component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

cap_holes_2 = CapHoles(Brep=loft)
deconstruct_brep_3 = DeconstructBrep(Brep=cap_holes_2)  # -> Faces, Edges, Vertices

area_2 = Area(Geometry=deconstruct_brep_3.Faces)  # -> Area, Centroid
deconstruct_3 = Deconstruct(Point=area_2.Centroid)  # -> XComponent, YComponent, flatten(ZComponent)
sort_list_4 = SortList(Keys=deconstruct_3.ZComponent, ValuesValuesA=flatten(deconstruct_3.ZComponent))  # -> Keys, ValuesValuesA
list_item_22 = ListItem(List=sort_list_4.Keys, Index="-1", Wrap=True)
list_item_23 = ListItem(List=sort_list_4.Keys, Index="0", Wrap=True)
member_index_9 = MemberIndex(Set=deconstruct_3.ZComponent, Member=list_item_22)  # -> Index, Count
member_index_10 = MemberIndex(Set=deconstruct_3.ZComponent, Member=list_item_23)  # -> Index, Count
list_item_24 = ListItem(List=deconstruct_brep_3.Faces, Index=member_index_9.Index, Wrap=True)
list_item_25 = ListItem(List=deconstruct_brep_3.Faces, Index=member_index_10.Index, Wrap=True)
cull_index_3 = CullIndex(List=deconstruct_brep_3.Faces, Indices=[member_index_9.Index, member_index_10.Index], Wrap=True)
cull_index_4 = CullIndex(List=area_2.Centroid, Indices=[member_index_9.Index, member_index_10.Index], Wrap=True)
deconstruct_4 = Deconstruct(Point=cull_index_4)  # -> XComponent, YComponent, flatten(ZComponent)
sort_list_5 = SortList(Keys=deconstruct_4.XComponent, ValuesValuesA=flatten(deconstruct_4.XComponent))  # -> Keys, ValuesValuesA
sort_list_6 = SortList(Keys=deconstruct_4.YComponent, ValuesValuesA=flatten(deconstruct_4.YComponent))  # -> Keys, ValuesValuesA
list_item_26 = ListItem(List=sort_list_5.ValuesValuesA, Index="0", Wrap=True)
list_item_27 = ListItem(List=sort_list_5.ValuesValuesA, Index="-1", Wrap=True)
list_item_28 = ListItem(List=sort_list_6.ValuesValuesA, Index="0", Wrap=True)
list_item_29 = ListItem(List=sort_list_6.ValuesValuesA, Index="-1", Wrap=True)
member_index_11 = MemberIndex(Set=deconstruct_4.XComponent, Member=list_item_26)  # -> Index, Count
member_index_12 = MemberIndex(Set=deconstruct_4.XComponent, Member=list_item_27)  # -> Index, Count
member_index_13 = MemberIndex(Set=deconstruct_4.YComponent, Member=list_item_28)  # -> Index, Count
member_index_14 = MemberIndex(Set=deconstruct_4.YComponent, Member=list_item_29)  # -> Index, Count
west_3 = ListItem(List=cull_index_3, Index=member_index_11.Index, Wrap=True)
east_3 = ListItem(List=cull_index_3, Index=member_index_12.Index, Wrap=True)

vizquick = HBVisualizeQuick(hb_objs=flatten(decnstrobj.apertures))  # -> geo; plug-in component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
roomsolid_2 = HBRoomFromSolid(geo=flatten(cap_holes_2), conditioned=True)  # -> out, rooms; plug-in component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
deconstruct_brep_4 = DeconstructBrep(Brep=cap_holes_2)  # -> Faces, Edges, Vertices
A_2 = ClusterInput()
explode_3 = Explode(Curve=vizquick, Recursive=True)  # -> Segments, Vertices
skylightsbyratio = HBSkylightsByRatio(hb_objs=flatten(roomsolid_2.rooms), ratio=colibri_inputs_iterator.Skylight_WWR)  # -> out, hb_objs; plug-in component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
modulus = Modulus(A=A_2, B=2)

# ---- group: South
east_4 = ListItem(List=cull_index_2, Index=member_index_5.Index, Wrap=True)

# ---- group: North
east_5 = ListItem(List=cull_index_2, Index=member_index_6.Index, Wrap=True)

# ---- group: South
east_6 = ListItem(List=cull_index_3, Index=member_index_13.Index, Wrap=True)

# ---- group: North
east_7 = ListItem(List=cull_index_3, Index=member_index_14.Index, Wrap=True)

# ----
list_item_30 = ListItem(List=deconstruct_brep_4.Faces, Index=0, Wrap=True)
panel_5 = Panel("""0
1""")
panel_6 = Panel("""2
3""")
list_length = ListLength(List=explode_3.Segments)  # -> flatten(Length)
indices = ClusterInput()
panel_7 = Panel("""Outdoors
Outdoors
Outdoors
Outdoors""")
stream_filter_2 = StreamFilter(Gate=modulus, Stream0=panel_6, Stream1=panel_5)
decnstrobj_2 = HBDeconstructObject(hb_obj=skylightsbyratio.hb_objs)  # -> faces, apertures, doors, shades; plug-in component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
set_a = ClusterInput()
set_a_2 = ClusterInput()
area_3 = Area(Geometry=list_item_30)  # -> Area, Centroid
gate = ClusterInput()
equality = Equality(FirstNumber=list_length, SecondNumber="3")  # -> Equality, Inequality
replace_items = ReplaceItems(List=panel_7, Item="Adiabatic", Indices=indices, Wrap=False)
set_intersection = SetIntersection(SetA=set_a, SetB=stream_filter_2)
set_difference_s = SetDifferenceS(SetA=set_a_2, SetB=set_intersection)
replace_items_2 = ReplaceItems(List=panel_7, Item="Adiabatic", Indices=set_difference_s, Wrap=False)
stream_filter_3 = StreamFilter(Gate=gate, Stream0="Outdoors", Stream1="Adiabatic")
vizquick_2 = HBVisualizeQuick(hb_objs=flatten(decnstrobj_2.apertures))  # -> geo; plug-in component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
list_item_31 = ListItem(List=replace_items, Index=0, Wrap=True)  # -> Item, Item1, Item2, Item3
constr = ClusterInput()

# ---- group: soil
decnstrconstr = HBDeconstructConstruction(constr=constr)  # -> materials, layers, r_val_si, r_val_ip, u_fac_si, u_fac_ip, shgc, t_sol, t_vis; plug-in component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
opaquemat = HBOpaqueMaterial(
    name="Gates_Clay_Soil_Material_15cm",
    thickness="0.15",
    conductivity="1",
    density="1600",
    spec_heat="890",
    roughness="Rough",
    therm_absp="0.9",
    sol_absp="0.7",
    vis_absp="0.7")  # -> mat; plug-in component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
merge_3 = Merge(Data1=flatten(opaquemat), Data2=decnstrconstr.materials)  # -> flatten(Result)
opaqueconstr = HBOpaqueConstruction(name="floor with soil", materials=merge_3)  # -> constr; plug-in component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
opaquemat_2 = HBOpaqueMaterial(
    name="Gates_Clay_Soil_Material_15cm",
    thickness="0.15",
    conductivity="1",
    density="1600",
    spec_heat="890",
    roughness="Rough",
    therm_absp="0.9",
    sol_absp="0.7",
    vis_absp="0.7")  # -> mat; plug-in component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
decnstrconstr_2 = HBDeconstructConstruction(constr=colibri_inputs_iterator.Floor_const)  # -> materials, layers, r_val_si, r_val_ip, u_fac_si, u_fac_ip, shgc, t_sol, t_vis; plug-in component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
merge_4 = Merge(Data1=flatten(opaquemat_2), Data2=decnstrconstr_2.materials)  # -> flatten(Result)
opaqueconstr_2 = HBOpaqueConstruction(name="floor with soil2", materials=merge_4)  # -> constr; plug-in component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

# ----
list_item_32 = ListItem(List=replace_items_2, Index=0, Wrap=True)  # -> Item, Item1, Item2, Item3
scale = Scale(Geometry=list_item_30, Center=area_3.Centroid, Factor=colibri_inputs_iterator.Exterior_wall_WWR)  # -> Geometry, Transform
boolean_toggle = BooleanToggle(False)
cull_pattern = CullPattern(List=vizquick, CullPattern=equality.Inequality)
ep_constr = ClusterInput()
ep_constr_2 = ClusterInput()
ep_constr_3 = ClusterInput()
ep_constr_4 = ClusterInput()
ep_constr_5 = ClusterInput()
ep_constr_6 = ClusterInput()

# ---- group: school hb windows
aperture = HBAperture(geo=cull_pattern, name="interior_window", operable=boolean_toggle, ep_constr=ep_constr)  # -> out, apertures; plug-in component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

# ----
face = HBFace(geo=east, name="classroom_east_wall", bc=list_item_31.Item1, ep_constr=ep_constr_3)  # -> out, faces; plug-in component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
face_2 = HBFace(geo=east_4, name="classroom_south_wall", bc=list_item_31.Item2, ep_constr=ep_constr_4)  # -> out, faces; plug-in component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

# ---- group: sunspace geometry
face_3 = HBFace(geo=west_3, name="sunspace_west_wall", bc=list_item_32.Item, ep_constr=colibri_inputs_iterator.Exterior_wall_const)  # -> out, faces; plug-in component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
face_4 = HBFace(geo=east_6, name="sunspace_south_wall", bc=list_item_32.Item2, ep_constr=ep_constr_6)  # -> out, faces; plug-in component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
face_5 = HBFace(geo=list_item_24, name="sunspace_roof", ep_constr=colibri_inputs_iterator.Exterior_wall_const)  # -> out, faces; plug-in component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
face_6 = HBFace(geo=list_item_25, name="sunspace_floor", ep_constr=opaqueconstr_2)  # -> out, faces; plug-in component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

# ----
face_7 = HBFace(geo=east_3, name="sunspace_east_wall", bc=list_item_32.Item1, ep_constr=colibri_inputs_iterator.Exterior_wall_const)  # -> out, faces; plug-in component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
face_8 = HBFace(geo=east_7, name="sunspace_north_wall", bc=list_item_32.Item3, ep_constr=colibri_inputs_iterator.Exterior_wall_const)  # -> out, faces; plug-in component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
id = HBSetIdentifier(hb_obj=face_3.faces, id="sunspace_west_wall")  # -> hb_obj; plug-in component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
id_2 = HBSetIdentifier(hb_obj=face_7.faces, id="sunspace_east_wall")  # -> hb_obj; plug-in component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
id_3 = HBSetIdentifier(hb_obj=face_4.faces, id="sunspace_south_wall")  # -> hb_obj; plug-in component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
id_4 = HBSetIdentifier(hb_obj=face_8.faces, id="sunspace_north_wall")  # -> hb_obj; plug-in component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
id_5 = HBSetIdentifier(hb_obj=face_5.faces, id="sunspace_roof")  # -> hb_obj; plug-in component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
id_6 = HBSetIdentifier(hb_obj=face_6.faces, id="sunspace_floor")  # -> hb_obj; plug-in component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
id_7 = HBSetIdentifier(hb_obj=face.faces, id="classroom_east_wall")  # -> hb_obj; plug-in component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
id_8 = HBSetIdentifier(hb_obj=face_2.faces, id="classroom_south_wall")  # -> hb_obj; plug-in component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
member = ClusterInput()

searchmats = HBSearchMaterials(keywords="metal")  # -> opaque_mats, window_mats; plug-in component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
searchmats_2 = HBSearchMaterials(keywords="concrete")  # -> opaque_mats, window_mats; plug-in component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
list_item_33 = ListItem(List=searchmats_2.opaque_mats, Index=Slider(4, range=0..100), Wrap=True)
list_item_34 = ListItem(List=searchmats.opaque_mats, Index=Slider(5, range=0..100), Wrap=True)
opaqueconstr_3 = HBOpaqueConstruction(name="Typical Mass RoofR-5.6", materials=[list_item_34, list_item_33])  # -> constr; plug-in component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
panel_8 = Panel("""Typical Insulated Metal Building Roof
Typical Insulated Metal Building Roof - Highly Reflective
Typical Insulated Metal Building Roof - Highly Reflective-R16
Typical Insulated Metal Building Roof - Highly Reflective-R25
Typical Insulated Metal Building Roof-R10
Typical Insulated Metal Building Roof-R12
Typical Insulated Metal Building Roof-R14
Typical Insulated Metal Building Roof-R16
Typical Insulated Metal Building Roof-R19
Typical Insulated Metal Building Roof-R21
Typical Insulated Metal Building Roof-R23
Typical Insulated Metal Building Roof-R25
Typical Insulated Metal Building Roof-R28
Typical Insulated Metal Building Roof-R29
Typical Insulated Metal Building Roof-R33
Typical Insulated Metal Building Roof-R35
Typical Insulated Metal Building Roof-R39
Typical Uninsulated Metal Building Roof
Typical Uninsulated Metal Building Roof - Highly Reflective
Typical Uninsulated Metal Roof Attic Roof
Typical Uninsulated Wood Joist Attic Roof""")
panel_9 = Panel("""Typical Insulated Metal Building Roof
Typical Insulated Metal Building Roof - Highly Reflective
Typical Insulated Metal Building Roof - Highly Reflective-R16
Typical Insulated Metal Building Roof - Highly Reflective-R25
Typical Insulated Metal Building Roof-R10
Typical Insulated Metal Building Roof-R12
Typical Insulated Metal Building Roof-R14
Typical Insulated Metal Building Roof-R16
Typical Insulated Metal Building Roof-R19
Typical Insulated Metal Building Roof-R21
Typical Insulated Metal Building Roof-R23
Typical Insulated Metal Building Roof-R25
Typical Insulated Metal Building Roof-R28
Typical Insulated Metal Building Roof-R29
Typical Insulated Metal Building Roof-R33
Typical Insulated Metal Building Roof-R35
Typical Insulated Metal Building Roof-R39
Typical Uninsulated Metal Building Roof
Typical Uninsulated Metal Building Roof - Highly Reflective
Typical Uninsulated Metal Roof Attic Roof
Typical Uninsulated Wood Joist Attic Roof
Typical Mass RoofR-5.6""")
merge_5 = Merge(Data1=opaqueconstr_3, Data2=panel_8)  # -> flatten(Result)
member_index_15 = MemberIndex(Set=panel_9, Member=member)  # -> Index, Count
list_item_35 = ListItem(List=merge_5, Index=member_index_15.Index, Wrap=True)

# ---- group: school geometry
face_9 = HBFace(geo=list_item_13, name="classroom_floor", ep_constr=opaqueconstr)  # -> out, faces; plug-in component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
face_10 = HBFace(geo=west, name="classroom_west_wall", bc=list_item_31.Item, ep_constr=ep_constr_2)  # -> out, faces; plug-in component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
face_11 = HBFace(geo=east_5, name="classroom_north_wall", bc=list_item_31.Item3, ep_constr=ep_constr_5)  # -> out, faces; plug-in component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
face_12 = HBFace(geo=list_item_12, name="classroom_roof", ep_constr=list_item_35)  # -> out, faces; plug-in component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

# ----
id_9 = HBSetIdentifier(hb_obj=face_9.faces, id="classroom_floor")  # -> hb_obj; plug-in component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
id_10 = HBSetIdentifier(hb_obj=face_10.faces, id="classroom_west_wall")  # -> hb_obj; plug-in component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
id_11 = HBSetIdentifier(hb_obj=face_11.faces, id="classroom_north_wall")  # -> hb_obj; plug-in component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
id_12 = HBSetIdentifier(hb_obj=face_12.faces, id="classroom_roof")  # -> hb_obj; plug-in component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
relay = Relay([id_6, id_5, id, id_2, id_4, id_3])
relay_2 = Relay([id_12, id_10, id_9, id_7, id_8, id_11])

# ---- group: hb rooms
room = HBRoom(faces=flatten(relay), name="sunspace", conditioned="False")  # -> out, room; plug-in component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
room_2 = HBRoom(faces=flatten(relay_2), name="school", conditioned=True)  # -> out, room; plug-in component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
id_13 = HBSetIdentifier(hb_obj=room.room, id="sunspace")  # -> hb_obj; plug-in component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
id_14 = HBSetIdentifier(hb_obj=room_2.room, id="school")  # -> hb_obj; plug-in component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

# ---- group: seasonal schedule for shades
panel_10 = Panel(ClusterInput())
panel_11 = Panel(ClusterInput())
panel_12 = Panel(ClusterInput())
panel_13 = Panel(ClusterInput())
analysisperiod = LBAnalysisPeriod(start_month=panel_12, start_day=1, start_hour=0, end_month=panel_10)  # -> period, hoys, dates; plug-in component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
analysisperiod_2 = LBAnalysisPeriod(start_month=panel_13, start_day=1, start_hour=0, end_month=panel_11)  # -> period, hoys, dates; plug-in component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

# ----
degrees = ClusterInput()

# ---- group: Site shading
number_slider = Slider(100, range=0..100)
radians = Radians(Degrees=degrees)
tangent = Tangent(Value=radians)
multiplication = Multiplication(A=number_slider, B=tangent)
circle = Circle(Plane=curve_middle, Radius=number_slider)
divide_curve = DivideCurve(Curve=circle, Count=Slider(2, range=0..10), Kinks=False)  # -> Points, Tangents, Parameters
shatter = Shatter(Curve=circle, Parameters=divide_curve.Parameters)
list_item_36 = ListItem(List=shatter, Index=0, Wrap=True)
divide_curve_2 = DivideCurve(Curve=list_item_36, Count=Slider(5, range=0..10), Kinks=False)  # -> Points, Tangents, Parameters
unit_z_4 = UnitZ(Factor=multiplication)
polyline_2 = PolyLine(Vertices=divide_curve_2.Points, Closed=False)
extrude_3 = Extrude(Base=polyline_2, Direction=unit_z_4)
shade = HBShade(geo=extrude_3)  # -> out, shades; plug-in component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

# ----
values = ClusterInput()
values_2 = ClusterInput()

# ---- group: program
constantschedule = HBConstantSchedule(values=values, name="heating_setpoint_schedule_daily", type_limit="Temperature")  # -> out, schedule, idf_text; plug-in component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
constantschedule_2 = HBConstantSchedule(values="50", name="heating_setpoint_schedule_daily", type_limit="Temperature")  # -> out, schedule, idf_text; plug-in component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
constantschedule_3 = HBConstantSchedule(values="0", name="cooling_setpoint_schedule_daily", type_limit="Temperature")  # -> out, schedule, idf_text; plug-in component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
constantschedule_4 = HBConstantSchedule(values=values_2, name="cooling_setpoint_schedule_daily", type_limit="Temperature")  # -> out, schedule, idf_text; plug-in component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
seasonalschedule = HBSeasonalSchedule(
    base_schedule=constantschedule_2.schedule,
    season_scheds=constantschedule_4.schedule,
    analysis_periods=analysisperiod_2.period)  # -> out, schedule, idf_year, idf_week, idf_days; plug-in component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
seasonalschedule_2 = HBSeasonalSchedule(
    base_schedule=constantschedule_3.schedule,
    season_scheds=constantschedule.schedule,
    analysis_periods=analysisperiod.period)  # -> out, schedule, idf_year, idf_week, idf_days; plug-in component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

programtype = HBProgramType(name="Sunspace_Sapce_Type")  # -> program; plug-in component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

panel_14 = Panel("""0
0
0
0
0
0
0
0
0
0
0
0
0
0
0
0
0
0
0
0
0
0
0
0""")
panel_15 = Panel("""0
0
0
0
0
0
0
0
1
1
1
1
1
1
1
1
1
1
0
0
0
0
0
0""")
weeklyschedule = HBWeeklySchedule(
    sun=panel_14,
    mon=panel_15,
    tue=panel_15,
    wed=panel_15,
    thu=panel_15,
    fri=panel_15,
    sat=panel_14,
    name="OccupancyHours",
    type_limit="Fractional")  # -> out, schedule, idf_year, idf_week, idf_days; plug-in component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
lighting = HBLighting(name="school_lighting", watts_per_area="11.25", schedule=weeklyschedule.schedule)  # -> lighting; plug-in component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
equipment = HBEquipment(name="school_equipment", watts_per_area="6", schedule=weeklyschedule.schedule)  # -> equip; plug-in component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
setpoint = HBSetpoint(heating_sch=constantschedule.schedule, cooling_sch=constantschedule_4.schedule)  # -> setpoint; plug-in component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
programtype_2 = HBProgramType(name="Classroom_Sapce_Type", lighting=lighting, electric_equip=equipment, setpoint=setpoint)  # -> program; plug-in component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
applyprogram = HBApplyProgramType(rooms=flatten(id_13), program=programtype)  # -> out, rooms; plug-in component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
applyprogram_2 = HBApplyProgramType(rooms=flatten(id_14), program=programtype_2)  # -> out, rooms; plug-in component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
applyroomsch = HBApplyRoomSchedules(
    room_or_program=flatten(applyprogram_2.rooms),
    heating_setpt_sch=seasonalschedule_2.schedule,
    cooling_setpt_sch=seasonalschedule.schedule)  # -> out, mod_obj; plug-in component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

# ----
panel_16 = Panel("""No_Movable_insulation
Reflective_Bubble_wrap
EPS100_Polystyrene_Insulation_Board
LUXOUS_1147_FR
Summer_shade""")
shademat = HBShadeMaterial(
    name="LUXOUS 1147 FR",
    thickness=".0002",
    transmittance="0.38",
    reflectance=".18",
    emissivity=".44",
    conductivity=".046",
    dist_to_glass=".001",
    open_mult=".001")  # -> mat; plug-in component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
shademat_2 = HBShadeMaterial(
    name="EPS100 Polystyrene Insulation Board",
    thickness=".05",
    transmittance=".001",
    reflectance=".9",
    emissivity=".9",
    conductivity=".036",
    dist_to_glass=".001",
    open_mult=".001")  # -> mat; plug-in component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
shademat_3 = HBShadeMaterial(
    name="Reflective Bubble wrap",
    thickness=".004",
    transmittance=".001",
    reflectance=".96",
    emissivity=".04",
    conductivity=".023",
    dist_to_glass=".001",
    open_mult=".001")  # -> mat; plug-in component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
shademat_4 = HBShadeMaterial(
    name="Summer_shade",
    thickness=".0003",
    transmittance="0.06",
    reflectance=".4",
    t_infrared="0",
    emissivity=".9",
    conductivity=".05",
    dist_to_glass=".001",
    permeability=".05")  # -> mat; plug-in component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
member_index_16 = MemberIndex(Set=panel_16, Member=colibri_inputs_iterator.Insulation_material)  # -> Index, Count
gate_2 = ClusterInput()
merge_6 = Merge(Data1="0", Data2=shademat_3, Data3=shademat_2, Data4=shademat, Data5=shademat_4)
stream_filter_4 = StreamFilter(Gate=gate_2, Stream0=member_index_16.Index, Stream1="4")
list_item_37 = ListItem(List=merge_6, Index=stream_filter_4, Wrap=True)
A_3 = ClusterInput()
subtraction_2 = Subtraction(A=A_3, B=1)
larger_than_2 = LargerThan(FirstNumber=member_index_16.Index, SecondNumber=0)  # -> LargerThan, OrEqualTo
absolute = Absolute(Value=subtraction_2)
solveadj = HBSolveAdjacency(rooms=flatten([applyroomsch.mod_obj, applyprogram.rooms]), run=Toggle(True))  # -> report, adj_rooms; plug-in component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
null_item = NullItem(Item=applyprogram.rooms)  # -> NullFlags, InvalidFlags, Description
multiplication_2 = Multiplication(A=larger_than_2.LargerThan, B=absolute)
A_4 = ClusterInput()
A_5 = ClusterInput()
B_2 = ClusterInput()
subtraction_3 = Subtraction(A=A_4, B=1)
first_number = ClusterInput()
stream_filter_5 = StreamFilter(Gate=null_item.NullFlags, Stream0=solveadj.adj_rooms, Stream1=applyroomsch.mod_obj)
absolute_2 = Absolute(Value=subtraction_3)
multiplication_3 = Multiplication(A=A_5, B=B_2)
larger_than_3 = LargerThan(FirstNumber=first_number, SecondNumber=0)  # -> LargerThan, OrEqualTo
stream_filter_6 = StreamFilter(Gate=larger_than_3.LargerThan, Stream0="Interior", Stream1="Exterior")

ghpython_script = GhPythonScript(x=panel_12, y=panel_10)  # -> out, a; inputs x: Int32, y: Int32
# ---------- ghpython_script: Python ----------
__author__ = "amomenae"
__version__ = "2024.10.15"

import rhinoscriptsyntax as rs

# Inputs: x (start month of heating season), y (end month of heating season)
# Example: x = 4 (April), y = 9 (September)

# Define the EMS program template with placeholders for the months
ems_program_template = """
EnergyManagementSystem:Program,
    Control_Shade_Program,        !- Name
    IF (Month >= {start_month}),  !- Program Line 1: Check if the month is the start month or later
        IF (Month <= {end_month}), !- Program Line 2: Check if the month is the end month or earlier
            IF (window_Net_Heat_Transfer > -80),   !- Program Line 3: Check net heat transfer
                IF (incident_solar_skylight > 0), !- Program Line 4: Check incident solar
                    SET Shade_Schedule_Actuator = 0,  !- Program Line 5: Open the shade (conditions met)
                ELSE,                             !- Program Line 6: If no solar gain
                    SET Shade_Schedule_Actuator = 1,  !- Program Line 7: Keep the shade closed
                ENDIF,                            !- End of incident solar check
            ELSE,                                 !- Program Line 8: If net heat transfer <= -80
                SET Shade_Schedule_Actuator = 1,  !- Program Line 9: Keep the shade closed
            ENDIF,                                !- End of net heat transfer check
        ELSE,                                     !- Program Line 10: Outside heating season (April to September)
            SET Shade_Schedule_Actuator = 0,      !- Program Line 11: Open the shade
        ENDIF,                                    !- End of month range check
    ELSE,                                         !- Program Line 12: Outside heating season (April to September)
        SET Shade_Schedule_Actuator = 0,          !- Program Line 13: Open the shade
    ENDIF;
"""

# Map the inputs x and y to the correct month formatting (e.g., 04 for April)
def format_month(month):
    # Ensure month is two digits (01, 02, ..., 12)
    return "{:02d}".format(month)

# Format the months
start_month = format_month(x)
end_month = format_month(y)

# Replace placeholders in the EMS program template with the actual months
output_ems_program = ems_program_template.format(start_month=start_month, end_month=end_month)

# Output the generated EMS program
a = output_ems_program
# ---------- end ghpython_script ----------
windowconstrshd = HBWindowConstructionShade(name="skylight_with_shade", win_constr=windowconstr, shd_material=list_item_37, shd_location=stream_filter_6)  # -> constr; plug-in component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
panel_17 = Panel(windowconstrshd)
winter_skylight_ems = Panel(ghpython_script.a)
winter_skylight_windowshadingcontrol = Panel("""WindowShadingControl,
  Interior_Shade_Control,         !- Name
  sunspace,                      !- Zone Name (replace with your actual zone name)
  ,                               !- Shading Control Sequence Number
  InteriorShade,                  !- Shading Type
  skylight_with_shade,                               !- Construction with Shading Name
  OnIfScheduleAllows,             !- Shading Control Type
  Shade_Control_Schedule,         !- Schedule Name
  ,                               !- Setpoint
  Yes,                               !- Shading Control Is Scheduled
  ,                               !- Glare Control Is Active
  ,          !- Shading Device Material Name
  ,                               !- Type of Slat Angle Control for Blinds
  ,                               !- Slat Angle Schedule Name
  ,                               !- Setpoint 2
  ,                               !- Daylighting Control Object Name
  ,                               !- Multiple Surface Control Type (leave blank if not used)
  skylight_window;                 !- Fenestration Surface 1 Name (replace with your actual window name)

Schedule:Compact,
  Shade_Control_Schedule,       !- Name
  AnyNumber,                   !- Schedule Type Limits Name
  Through: 12/31,               !- Field 1
  For: AllDays,                 !- Field 2
  Until: 24:00,0;               !- Field 3 (default to 0, i.e., shades off)

EnergyManagementSystem:Sensor,
  Window_Net_Heat_Transfer,       !- Name
  skylight_window,                      !- Output:Variable or Output:Meter Index Key Name
  Surface Window Net Heat Transfer Rate;  !- Output:Variable or Output:Meter Name

EnergyManagementSystem:Actuator,
  Shade_Schedule_Actuator,        !- Name
  Shade_Control_Schedule,         !- Actuated Component Unique Name
  Schedule:Compact,               !- Actuated Component Type
  Schedule Value;                 !- Actuated Component Control Type

EnergyManagementSystem:Sensor,
    incident_solar_skylight,                        !- Name of the sensor (you can name it as needed)
    skylight_window,                          !- Name of the zone you are monitoring (replace with your zone name)
    Surface Outside Face Incident Solar Radiation Rate per Area;  !- Output:Variable or Meter Name


Output:Variable,
    vertical_window,                          !- Key Value (replace with your zone name)
    Surface Outside Face Incident Solar Radiation Rate per Area, !- Variable Name
    Timestep;    



Output:Variable,
    skylight_window,                          !- Key Value (replace with your zone name)
    Surface Outside Face Incident Solar Radiation Rate per Area, !- Variable Name
    Timestep;          


EnergyManagementSystem:ProgramCallingManager,
  Control_Shade_Schedule,         !- Name
  BeginTimestepBeforePredictor,   !- EnergyPlus Model Calling Point
  Control_Shade_Program;          !- Program Name 1


Output:Variable,
  skylight_window,                   !- Key Value
  Surface Window Net Heat Transfer Rate,  !- Variable Name
  Timestep;                         !- Reporting Frequency

EnergyManagementSystem:OutputVariable,
    EMS_Shade_Schedule_Actuator,     !- Name
    Shade_Schedule_Actuator,         !- EMS Variable Name
    Averaged,                    !- Type of Data in Variable
    ZoneTimeStep;                !- Update Frequency

Output:Variable,
    Shade_Control_Schedule,           !- Key Value
    Schedule Value,              !- Variable Name
    Timestep;                    !- Reporting Frequency""")
summer_skylight_windowshadingcontrol = Panel("""WindowShadingControl,
  Interior_Shade_Control,         !- Name
  sunspace,                      !- Zone Name (replace with your actual zone name)
  ,                               !- Shading Control Sequence Number
  ExteriorShade,                  !- Shading Type
  skylight_with_shade,                               !- Construction with Shading Name
  OnIfScheduleAllows,             !- Shading Control Type
  Shade_Control_Schedule,         !- Schedule Name
  ,                               !- Setpoint
  Yes,                               !- Shading Control Is Scheduled
  ,                               !- Glare Control Is Active
  ,          !- Shading Device Material Name
  ,                               !- Type of Slat Angle Control for Blinds
  ,                               !- Slat Angle Schedule Name
  ,                               !- Setpoint 2
  ,                               !- Daylighting Control Object Name
  ,                               !- Multiple Surface Control Type (leave blank if not used)
  skylight_window;                 !- Fenestration Surface 1 Name (replace with your actual window name)

Schedule:Compact,
  Shade_Control_Schedule,       !- Name
  AnyNumber,                   !- Schedule Type Limits Name
  Through: 12/31,               !- Field 1
  For: AllDays,                 !- Field 2
  Until: 24:00,0;               !- Field 3 (default to 0, i.e., shades off)


EnergyManagementSystem:Actuator,
  Shade_Schedule_Actuator,        !- Name
  Shade_Control_Schedule,         !- Actuated Component Unique Name
  Schedule:Compact,               !- Actuated Component Type
  Schedule Value;                 !- Actuated Component Control Type



EnergyManagementSystem:ProgramCallingManager,
  Control_Shade_Schedule,         !- Name
  BeginTimestepBeforePredictor,   !- EnergyPlus Model Calling Point
  Control_Shade_Program;          !- Program Name 1


                        !- Reporting Frequency

EnergyManagementSystem:OutputVariable,
    EMS_Shade_Schedule_Actuator,     !- Name
    Shade_Schedule_Actuator,         !- EMS Variable Name
    Averaged,                    !- Type of Data in Variable
    ZoneTimeStep;                !- Update Frequency

Output:Variable,
    Shade_Control_Schedule,           !- Key Value
    Schedule Value,              !- Variable Name
    Timestep;                    !- Reporting Frequency""")
summer_skylight_ems = Panel("""EnergyManagementSystem:Program,
    Control_Shade_Program,

    SET Shade_Schedule_Actuator = 0,  ! Default: shade OFF

    IF (Month <= 3),
        IF (Hour >= 8),
            IF (Hour < 17),
                SET Shade_Schedule_Actuator = 1,
            ENDIF,
        ENDIF,
    
    ELSEIF (Month >= 10),
        IF (Hour >= 8),
            IF (Hour < 17),
                SET Shade_Schedule_Actuator = 1,
            ENDIF,
        ENDIF,
    ENDIF;""")

# ---- group: window (movable insulation)
windowconstrshd_2 = HBWindowConstructionShade(name="vertical_window_with_shade", win_constr=windowconstr_2, shd_material=list_item_37, shd_location=stream_filter_6)  # -> constr; plug-in component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
ghpython_script_2 = GhPythonScript(x=panel_12, y=panel_10)  # -> out, a; inputs x: Int32, y: Int32
# ---------- ghpython_script_2: Python ----------
__author__ = "amomenae"
__version__ = "2024.10.15"

import rhinoscriptsyntax as rs

# Inputs: x (start month of shade control), y (end month of shade control)
# Example: x = 4 (April), y = 9 (September)

# Define the EMS program template with placeholders for the months
ems_program_template = """
EnergyManagementSystem:Program,
    Control_Shade_Program_2,        !- Name
    IF (Month >= {start_month}),    !- Program Line 1: Check if the month is the start month or later
        IF (Month <= {end_month}),  !- Program Line 2: Check if the month is the end month or earlier
            IF (Window_Net_Heat_Transfer_2 > -80),   !- Program Line 3: First condition: solar gain is greater than 0
                IF (incident_solar_window > 0),      !- Program Line 4: Second condition: incident solar
                    SET Shade_Schedule_Actuator_2 = 0,  !- Program Line 5: Open the shade (both conditions met)
                ELSE,                                !- Program Line 6: If net heat transfer is less than -80
                    SET Shade_Schedule_Actuator_2 = 1,  !- Program Line 7: Keep the shade closed
                ENDIF,                               !- End of nested IF for net heat transfer
            ELSE,                                    !- Program Line 8: If solar gain is less than or equal to 0
                SET Shade_Schedule_Actuator_2 = 1,   !- Program Line 9: Keep the shade closed
            ENDIF,                                   !- End of first IF for solar gain
        ELSE,                                        !- Program Line 10: If month is not between {start_month} and {end_month}
            SET Shade_Schedule_Actuator_2 = 0,       !- Program Line 11: Keep the shade open
        ENDIF,                                       !- End of month check IF
    ELSE,                                            !- Program Line 12: If month is not between {start_month} and {end_month}
        SET Shade_Schedule_Actuator_2 = 0,           !- Program Line 13: Keep the shade open
    ENDIF;
"""

# Map the inputs x and y to the correct month formatting (e.g., 04 for April)
def format_month(month):
    # Ensure month is two digits (01, 02, ..., 12)
    return "{:02d}".format(month)

# Format the months
start_month = format_month(x)
end_month = format_month(y)

# Replace placeholders in the EMS program template with the actual months
output_ems_program = ems_program_template.format(start_month=start_month, end_month=end_month)

# Output the generated EMS program
a = output_ems_program
# ---------- end ghpython_script_2 ----------
panel_18 = Panel(list_item_37)
winter_verticalwindow_windowshadingcontr = Panel("""WindowShadingControl,
  Interior_Shade_Control_2,         !- Name
  sunspace,                      !- Zone Name (replace with your actual zone name)
  ,                               !- Shading Control Sequence Number
  InteriorShade,                  !- Shading Type
  vertical_window_with_shade,                               !- Construction with Shading Name
  OnIfScheduleAllows,             !- Shading Control Type
  Shade_Control_Schedule_2,         !- Schedule Name
  ,                               !- Setpoint
  Yes,                               !- Shading Control Is Scheduled
  ,                               !- Glare Control Is Active
  ,          !- Shading Device Material Name
  ,                               !- Type of Slat Angle Control for Blinds
  ,                               !- Slat Angle Schedule Name
  ,                               !- Setpoint 2
  ,                               !- Daylighting Control Object Name
  ,                               !- Multiple Surface Control Type (leave blank if not used)
  vertical_window;                 !- Fenestration Surface 1 Name (replace with your actual window name)

Schedule:Compact,
  Shade_Control_Schedule_2,       !- Name
  Any Number,                   !- Schedule Type Limits Name
  Through: 12/31,               !- Field 1
  For: AllDays,                 !- Field 2
  Until: 24:00,0;               !- Field 3 (default to 0, i.e., shades off)

EnergyManagementSystem:Sensor,
  Window_Net_Heat_Transfer_2,       !- Name
  vertical_window,                      !- Output:Variable or Output:Meter Index Key Name
  Surface Window Net Heat Transfer Rate;  !- Output:Variable or Output:Meter Name


EnergyManagementSystem:Actuator,
  Shade_Schedule_Actuator_2,        !- Name
  Shade_Control_Schedule_2,         !- Actuated Component Unique Name
  Schedule:Compact,               !- Actuated Component Type
  Schedule Value;                 !- Actuated Component Control Type

EnergyManagementSystem:Sensor,
    incident_solar_window,                        !- Name of the sensor (you can name it as needed)
    vertical_window,                          !- Name of the zone you are monitoring (replace with your zone name)
    Surface Outside Face Incident Solar Radiation Rate per Area;  !- Output:Variable or Meter Name


Output:Variable,
    vertical_window,                          !- Key Value (replace with your zone name)
    Surface Outside Face Incident Solar Radiation Rate per Area, !- Variable Name
    Timestep;

EnergyManagementSystem:Sensor,
    Zone_Solar_Gain,                        !- Name of the sensor (you can name it as needed)
    SUNSPACE_SPACE,                          !- Name of the zone you are monitoring (replace with your zone name)
    Zone Windows Total Transmitted Solar Radiation Rate;  !- Output:Variable or Meter Name


Output:Variable,
    SUNSPACE_SPACE,                          !- Key Value (replace with your zone name)
    Zone Windows Total Transmitted Solar Radiation Rate, !- Variable Name
    Timestep;



EnergyManagementSystem:ProgramCallingManager,
  Control_Shade_Schedule_2,         !- Name
  BeginTimestepBeforePredictor,   !- EnergyPlus Model Calling Point
  Control_Shade_Program_2;          !- Program Name 1

Output:Variable,
  vertical_window,                   !- Key Value
  Surface Window Net Heat Transfer Rate,  !- Variable Name
  Timestep;                         !- Reporting Frequency

EnergyManagementSystem:OutputVariable,
    EMS_Shade_Schedule_Actuator_2,     !- Name
    Shade_Schedule_Actuator_2,         !- EMS Variable Name
    Averaged,                    !- Type of Data in Variable
    ZoneTimeStep;                !- Update Frequency

Output:Variable,
    Shade_Control_Schedule_2,           !- Key Value
    Schedule Value,              !- Variable Name
    Timestep;                    !- Reporting Frequency""")  # "Winter-verticalwindow-Windowshadingcontrol"
panel_19 = Panel(windowconstrshd_2)
summer_verticalwindow_windowshadingcontr = Panel("""WindowShadingControl,
  Interior_Shade_Control_2,         !- Name
  sunspace,                      !- Zone Name (replace with your actual zone name)
  ,                               !- Shading Control Sequence Number
  ExteriorShade,                  !- Shading Type
  vertical_window_with_shade,                               !- Construction with Shading Name
  OnIfScheduleAllows,             !- Shading Control Type
  Shade_Control_Schedule_2,         !- Schedule Name
  ,                               !- Setpoint
  Yes,                               !- Shading Control Is Scheduled
  ,                               !- Glare Control Is Active
  ,          !- Shading Device Material Name
  ,                               !- Type of Slat Angle Control for Blinds
  ,                               !- Slat Angle Schedule Name
  ,                               !- Setpoint 2
  ,                               !- Daylighting Control Object Name
  ,                               !- Multiple Surface Control Type (leave blank if not used)
  vertical_window;                 !- Fenestration Surface 1 Name (replace with your actual window name)

Schedule:Compact,
  Shade_Control_Schedule_2,       !- Name
  Any Number,                   !- Schedule Type Limits Name
  Through: 12/31,               !- Field 1
  For: AllDays,                 !- Field 2
  Until: 24:00,0;               !- Field 3 (default to 0, i.e., shades off)




EnergyManagementSystem:Actuator,
  Shade_Schedule_Actuator_2,        !- Name
  Shade_Control_Schedule_2,         !- Actuated Component Unique Name
  Schedule:Compact,               !- Actuated Component Type
  Schedule Value;                 !- Actuated Component Control Type



EnergyManagementSystem:ProgramCallingManager,
  Control_Shade_Schedule_2,         !- Name
  BeginTimestepBeforePredictor,   !- EnergyPlus Model Calling Point
  Control_Shade_Program_2;          !- Program Name 1

EnergyManagementSystem:OutputVariable,
    EMS_Shade_Schedule_Actuator_2,     !- Name
    Shade_Schedule_Actuator_2,         !- EMS Variable Name
    Averaged,                    !- Type of Data in Variable
    ZoneTimeStep;                !- Update Frequency

Output:Variable,
    Shade_Control_Schedule_2,           !- Key Value
    Schedule Value,              !- Variable Name
    Timestep;                    !- Reporting Frequency""")  # "Summer-verticalwindow-Windowshadingcontrol"
winter_verticalwindow_ems = Panel(ghpython_script_2.a)
summer_verticalwindow_ems = Panel("""EnergyManagementSystem:Program,
    Control_Shade_Program_2 ,

    SET Shade_Schedule_Actuator_2 = 0,  ! Default: shade OFF

    IF (Month <= 3),
        IF (Hour >= 8),
            IF (Hour < 17),
                SET Shade_Schedule_Actuator_2  = 1,
            ENDIF,
        ENDIF,
    
    ELSEIF (Month >= 10),
        IF (Hour >= 8),
            IF (Hour < 17),
                SET Shade_Schedule_Actuator_2  = 1,
            ENDIF,
        ENDIF,
    ENDIF;""")

# ----
relay_3 = Relay()
relay_4 = Relay([panel_17, panel_19, summer_skylight_windowshadingcontrol, summer_skylight_ems, summer_verticalwindow_windowshadingcontr, summer_verticalwindow_ems, panel_18])
relay_5 = Relay([winter_skylight_windowshadingcontrol, panel_17, winter_skylight_ems, panel_18, winter_verticalwindow_windowshadingcontr, panel_19, winter_verticalwindow_ems])
addition_2 = Addition(A=colibri_inputs_iterator.Sunspace_depth, B=absolute_2)
x = ClusterInput()
x_2 = ClusterInput()
stream_filter_7 = StreamFilter(Gate=multiplication_2, Stream1=relay_5)
stream_filter_8 = StreamFilter(Gate=multiplication_3, Stream0=stream_filter_7, Stream1=relay_4)
x_3 = ClusterInput()
boolean = Boolean(addition_2)
stream_filter_9 = StreamFilter(Gate=boolean, Stream1=stream_filter_8)
ghpython_script_3 = GhPythonScript(x=x)  # -> out, a
# ---------- ghpython_script_3: Python ----------
"""
Inputs:
    x: Air Changes per Hour (ACH), e.g., 0.5
Output:
    a: ZoneVentilation:DesignFlowRate object for EnergyPlus
"""

# Define the ZoneVentilation object as a formatted string template
zone_ventilation_template = """
ZoneVentilation:DesignFlowRate,
    MyZone Ventilation2,       !- Name
    sunspace,                  !- Zone or ZoneList or Space or SpaceList Name
    Always On,                 !- Schedule Name
    AirChanges/Hour,           !- Design Flow Rate Calculation Method
    ,                          !- Design Flow Rate {{m3/s}}
    ,                          !- Flow Rate per Floor Area {{m3/s-m2}}
    ,                          !- Flow Rate per Person {{m3/s-person}}
    {ach},                     !- Air Changes per Hour {{1/hr}}
    Natural,                   !- Ventilation Type
    0.0,                       !- Fan Pressure Rise {{Pa}}
    1.0,                       !- Fan Total Efficiency
    1.0,                       !- Constant Term Coefficient
    0.0,                       !- Temperature Term Coefficient
    0.0,                       !- Velocity Term Coefficient
    0.0,                       !- Velocity Squared Term Coefficient
    -100,                      !- Minimum Indoor Temperature {{C}}
    ,                          !- Minimum Indoor Temperature Schedule Name
    100,                       !- Maximum Indoor Temperature {{C}}
    ,                          !- Maximum Indoor Temperature Schedule Name
    -100,                      !- Delta Temperature {{deltaC}}
    ,                          !- Delta Temperature Schedule Name
    -100,                      !- Minimum Outdoor Temperature {{C}}
    ,                          !- Minimum Outdoor Temperature Schedule Name
    100,                      !- Maximum Outdoor Temperature {{C}}
    ,                          !- Maximum Outdoor Temperature Schedule Name
    40;                        !- Maximum Wind Speed {{m/s}}
"""

# Format the template using input x
output_string = zone_ventilation_template.format(ach=x)

# Output to Grasshopper
a = output_string
# ---------- end ghpython_script_3 ----------
ghpython_script_4 = GhPythonScript(x=x_2)  # -> out, a
# ---------- ghpython_script_4: Python ----------
"""
Inputs:
    x: Air Changes per Hour (ACH), e.g., 0.5
Output:
    a: ZoneVentilation:DesignFlowRate object for EnergyPlus
"""

# Define the ZoneVentilation object as a formatted string template
zone_ventilation_template = """
ZoneVentilation:DesignFlowRate,
    MyZone Ventilation,       !- Name
    school,                  !- Zone or ZoneList or Space or SpaceList Name
    Always On,                 !- Schedule Name
    AirChanges/Hour,           !- Design Flow Rate Calculation Method
    ,                          !- Design Flow Rate {{m3/s}}
    ,                          !- Flow Rate per Floor Area {{m3/s-m2}}
    ,                          !- Flow Rate per Person {{m3/s-person}}
    {ach},                     !- Air Changes per Hour {{1/hr}}
    Natural,                   !- Ventilation Type
    0.0,                       !- Fan Pressure Rise {{Pa}}
    1.0,                       !- Fan Total Efficiency
    1.0,                       !- Constant Term Coefficient
    0.0,                       !- Temperature Term Coefficient
    0.0,                       !- Velocity Term Coefficient
    0.0,                       !- Velocity Squared Term Coefficient
    -100,                      !- Minimum Indoor Temperature {{C}}
    ,                          !- Minimum Indoor Temperature Schedule Name
    100,                       !- Maximum Indoor Temperature {{C}}
    ,                          !- Maximum Indoor Temperature Schedule Name
    -100,                      !- Delta Temperature {{deltaC}}
    ,                          !- Delta Temperature Schedule Name
    -100,                      !- Minimum Outdoor Temperature {{C}}
    ,                          !- Minimum Outdoor Temperature Schedule Name
    100,                      !- Maximum Outdoor Temperature {{C}}
    ,                          !- Maximum Outdoor Temperature Schedule Name
    40;                        !- Maximum Wind Speed {{m/s}}
"""

# Format the template using input x
output_string = zone_ventilation_template.format(ach=x)

# Output to Grasshopper
a = output_string
# ---------- end ghpython_script_4 ----------
ghpython_script_5 = GhPythonScript(x=x_3)  # -> out, a
# ---------- ghpython_script_5: Python ----------
"""
Inputs:
    x: People per Zone Floor Area (e.g., 0.83)
Output:
    a: EnergyPlus People object string
"""

# Define the EnergyPlus People object as a string template
people_object_template = """
People,
    Classroom People,            !- Name
    school,                      !- Zone or ZoneList Name
    OccupancySchedule,           !- Number of People Schedule Name
    People/Area,                 !- Number of People Calculation Method
    ,                            !- Number of People
    {people_area},               !- People per Zone Floor Area (person/m2)
    ,                            !- Zone Floor Area per Person (m2)
    0.3,                         !- Fraction Radiant
    0.6,                         !- Sensible Heat Fraction
    ActivityLevelSchedule,       !- Activity Level Schedule Name
    0.0000000382;                !- Carbon Dioxide Generation Rate (m3/s-Watt)
"""

# Format the string using input x
output_string = people_object_template.format(people_area=x)

# Output the formatted string to Grasshopper
a = output_string
# ---------- end ghpython_script_5 ----------

panel_20 = Panel("""Output:Variable,
    school,                        !- Key Value
    Zone Operative Temperature, !- Variable Name
    Timestep;                   !- Reporting Frequency""")
panel_21 = Panel("""Output:Variable,
    school,                              !- Key Value (use * to apply to all zones)
    Zone Air System Sensible Heating Rate, !- Variable Name
    Hourly;                          !- Reporting Frequency (can be Hourly, Daily, Monthly, or Timestep)

Output:Variable,
    school,                              !- Key Value (use * to apply to all zones)
    Zone Predicted Sensible Load to Heating Setpoint Heat Transfer Rate, !- Variable Name
    Hourly;                          !- Reporting Frequency (can be Hourly, Daily, Monthly, or Timestep)

Output:Variable,
    school,                              !- Key Value (use * to apply to all zones)
    Zone Air System Sensible Cooling Rate, !- Variable Name
    Hourly;                          !- Reporting Frequency (can be Hourly, Daily, Monthly, or Timestep)

Output:Variable,
    school,                              !- Key Value (use * to apply to all zones)
    Zone Predicted Sensible Load to Cooling Setpoint Heat Transfer Rate, !- Variable Name
    Hourly;                          !- Reporting Frequency (can be Hourly, Daily, Monthly, or Timestep)

Output:Variable,
    school,                              !- Key Value (use * to apply to all zones)
    Zone Ideal Loads Zone Total Heating Energy, !- Variable Name
    Timestep;                          !- Reporting Frequency (can be Hourly, Daily, Monthly, or Timestep)""")
panel_22 = Panel("""Output:Variable,
    *,                        !- Key Value
    Zone Mean Air Temperature, !- Variable Name
    Timestep;                   !- Reporting Frequency""")
panel_23 = Panel("""Output:Variable,
    *,                            !- Key Value
    Site Outdoor Air Drybulb Temperature, !- Variable Name
    Timestep;                   !- Reporting Frequency""")
panel_24 = Panel("""Output:Variable,
    *,                        !- Key Value
    Zone Interior Windows Total Transmitted Beam Solar Radiation Rate,
 !- Variable Name
    hourly;                   !- Reporting Frequency

Output:Variable,
    *,                        !- Key Value
    Zone Interior Windows Total Transmitted Diffuse Solar Radiation Rate,
 !- Variable Name
    hourly;                   !- Reporting Frequency""")
panel_25 = Panel("""Output:Variable,
    *,                        !- Key Value
    Surface Window Heat Loss Energy,
 !- Variable Name
    hourly;                   !- Reporting Frequency

Output:Variable,
    *,                        !- Key Value
    Surface Window Heat Gain Energy,
 !- Variable Name
    hourly;                   !- Reporting Frequency""")
panel_26 = Panel("""Output:Variable,
  skylight_window,                   !- Key Value
  Surface Window Transmitted Solar Radiation Energy,  !- Variable Name
  Timestep;                         !- Reporting Frequency""")
panel_27 = Panel("""Output:Variable,
  vertical_window,                   !- Key Value
  Surface Window Transmitted Solar Radiation Energy,  !- Variable Name
  Timestep;                         !- Reporting Frequency""")
relay_6 = Relay([panel_27, panel_26])

co2 = Panel("""People,
  Classroom teacher,            !- Name
  school,                   !- Zone or ZoneList Name
  OccupancySchedule,           !- Number of People Schedule Name
  People,                 !- Number of People Calculation Method
  1,                            !- Number of People
  ,                         !- People per Zone Floor Area (person/m2)
  ,                            !- Zone Floor Area per Person (m2)
  0.3,                    !- Carbon Dioxide Generation Rate (m3/s-Watt)
  0.6,                         !- Sensible Heat Fraction (replace "No" with a number)
  ActivityLevelSchedule2,        !- Activity Level Schedule Name
  0.0000000382;			!-Carbon Dioxide Generation Rate (m3/s-Watt)








! === OCCUPANCY SCHEDULE ===
Schedule:Compact,
  OccupancySchedule,           !- Name
  Fractional,                    !- Schedule Type Limits Name
  Through: 12/31,              !- Field 1
  For: Weekdays,               !- Field 2
  Until: 08:00, 0.0,           !- Field 3
  Until: 17:00, 1.0,           !- Field 4
  Until: 24:00, 0.0,           !- Field 5
  For: Weekends,               !- Field 6
  Until: 24:00, 0.0,           !- Field 7
  For AllOtherDays,
  Until: 24:00, 0.0;





! === ACTIVITY LEVEL SCHEDULE ===
Schedule:Compact,
  ActivityLevelSchedule,       !- Name
  Activity Level2,                   !- Schedule Type Limits Name
  Through: 12/31,              !- Field 1
  For: AllDays,               !- Field 2
  Until: 24:00, 100.0;



! === ACTIVITY LEVEL SCHEDULE ===
Schedule:Compact,
  ActivityLevelSchedule2,       !- Name
  Activity Level2,                   !- Schedule Type Limits Name
  Through: 12/31,              !- Field 1
  For: AllDays,               !- Field 2
  Until: 24:00, 130.0;



Schedule:Compact,
  Outdoor_CO2_Schedule,        !- Name
  AnyNumber,                   !- Schedule Type Limits Name
  Through: 01/31,              !- Field 1 (January)
  For: AllDays,                !- Field 2
  Until: 24:00, 417.18,        !- Field 3
  Through: 02/28,              !- Field 4 (February)
  For: AllDays,                !- Field 5
  Until: 24:00, 417.64,        !- Field 6
  Through: 03/31,              !- Field 7 (March)
  For: AllDays,                !- Field 8
  Until: 24:00, 418.16,        !- Field 9
  Through: 04/30,              !- Field 10 (April)
  For: AllDays,                !- Field 11
  Until: 24:00, 418.58,        !- Field 12
  Through: 05/31,              !- Field 13 (May)
  For: AllDays,                !- Field 14
  Until: 24:00, 418.45,        !- Field 15
  Through: 06/30,              !- Field 16 (June)
  For: AllDays,                !- Field 17
  Until: 24:00, 417.43,        !- Field 18
  Through: 07/31,              !- Field 19 (July)
  For: AllDays,                !- Field 20
  Until: 24:00, 415.68,        !- Field 21
  Through: 08/31,              !- Field 22 (August)
  For: AllDays,                !- Field 23
  Until: 24:00, 414.41,        !- Field 24
  Through: 09/30,              !- Field 25 (September)
  For: AllDays,                !- Field 26
  Until: 24:00, 414.63,        !- Field 27
  Through: 10/31,              !- Field 28 (October)
  For: AllDays,                !- Field 29
  Until: 24:00, 416.14,        !- Field 30
  Through: 11/30,              !- Field 31 (November)
  For: AllDays,                !- Field 32
  Until: 24:00, 417.77,        !- Field 33
  Through: 12/31,              !- Field 34 (December)
  For: AllDays,                !- Field 35
  Until: 24:00, 418.80;        !- Field 36


! === ZONE AIR CONTAMINANT BALANCE ===
ZoneAirContaminantBalance,
  Yes,                          !- Carbon Dioxide Concentration
  Outdoor_CO2_Schedule,         !- Outdoor Carbon Dioxide Schedule Name
  No,                           !- Generic Contaminant Concentration
  ;                             !- Outdoor Generic Contaminant Schedule Name (blank)


! === CO2 OUTPUT VARIABLE ===
Output:Variable,
  school,                   !- Key Value
  Zone Air CO2 Concentration,   !- Variable Name
  Timestep;                      !- Reporting Frequency

ScheduleTypeLimits,
    Activity Level2,                      !- Name
    70,                           !- Lower Limit Value
    1000,                           !- Upper Limit Value
    Discrete,                    !- Numeric Type
    activitylevel;

ScheduleTypeLimits,
    AnyNumber,                      !- Name
    -1000,                           !- Lower Limit Value
    1000,                           !- Upper Limit Value
    Continuous,                    !- Numeric Type
    ;""")
co2_2 = Panel(ghpython_script_5.a)

ghpython_script_6 = GhPythonScript(x=panel_12, y=panel_10)  # -> out, a; inputs x: Int32, y: Int32
# ---------- ghpython_script_6: Python ----------
__author__ = "amomenae"
__version__ = "2024.10.15"

import rhinoscriptsyntax as rs
# Inputs: x (int), y (int)

# Define the EnergyManagementSystem string template
ems_program_template = """
EnergyManagementSystem:Program,
    MyMixingControlProgram,      !- Name
    SET HeatLossThreshold = 0.005,  !- Set a small threshold value
    IF (Month >= {x}) THEN,          !- Check if current month is within the range
        IF (Month <= {y}) THEN,      !- Ensure it's within the active season
            IF (School_SensibleHeatLoss <= HeatLossThreshold) THEN, !- Check heat loss condition
                IF (Sunspace_Temp > School_Temp) THEN,  !- Check if the sunspace is warmer
                    SET SeasonalMixSchedule = 1,  !- Enable mixing
                ELSE,
                    SET SeasonalMixSchedule = 0,  !- Disable mixing if sunspace is not warm enough
                ENDIF,
            ELSE,
                SET SeasonalMixSchedule = 0,  !- Disable mixing if heat loss is too high
            ENDIF,
        ELSE,
            SET SeasonalMixSchedule = 0,  !- Disable mixing if outside the defined months
        ENDIF,
    ELSE,
        SET SeasonalMixSchedule = 0,  !- Disable mixing if outside the defined months
    ENDIF;
"""

# Replace placeholders with the input values of x and y
output_string = ems_program_template.format(x=x, y=y)

# Output the formatted string
a = output_string
# ---------- end ghpython_script_6 ----------
ghpython_script_7 = GhPythonScript(x=panel_12, y=panel_10)  # -> out, a; inputs x: Int32, y: Int32
# ---------- ghpython_script_7: Python ----------
__author__ = "amomenae"
__version__ = "2024.10.15"

import rhinoscriptsyntax as rs

# Inputs: x (start month of heating season), y (end month of heating season)
# Example: x = 4 (April), y = 9 (September)

# Define the schedule template for heating season between April and September
schedule_template = """
Schedule:Compact,
    SEASONAL_SCHEDULE,           !- Name
    On/Off,                      !- Schedule Type Limits Name
    Through: {before_heating_month}/{last_day_of_before_heating_month}, !- Field 1 (Non-heating period ends)
    For: AllDays,                !- Field 2
    Until: 24:00, 0,             !- Field 3 (Heating off)
    Through: {end_month}/30,     !- Field 4 (Heating season ends)
    For: AllDays,                !- Field 5
    Until: 24:00, 0,             !- Field 6 (Heating on)
    Through: 12/31,              !- Field 7 (End of the year)
    For: AllDays,                !- Field 8
    Until: 24:00, 0;             !- Field 9 (Heating off)
"""

# Function to get the number of days in a month
def get_last_day_of_month(month):
    if month in [1, 3, 5, 7, 8, 10, 12]:
        return 31
    elif month in [4, 6, 9, 11]:
        return 30
    elif month == 2:
        return 28  # Assuming non-leap year for simplicity
    return 30  # Default case

# Map the inputs x and y to the correct month formatting (e.g., 04 for April)
def format_month(month):
    # Use .format() method to ensure month is two digits (01, 02, ..., 12)
    return "{:02d}".format(month)

# Calculate the month before heating season starts
before_heating_month = x - 1 if x > 1 else 12  # Previous month or wrap around to December
last_day_of_before_heating_month = get_last_day_of_month(before_heating_month)  # Correct last day

# Format the months
start_month = format_month(x)
end_month = format_month(y)
before_heating_month_formatted = format_month(before_heating_month)

# Replace placeholders in the schedule template with the actual months and last day
output_schedule = schedule_template.format(before_heating_month=before_heating_month_formatted,
                                           last_day_of_before_heating_month=last_day_of_before_heating_month,
                                           end_month=end_month)

# Output the generated schedule
a = output_schedule
# ---------- end ghpython_script_7 ----------
panel_28 = Panel(ghpython_script_6.a)
panel_29 = Panel(ghpython_script_7.a)
ems_calling_and_control = Panel("""EnergyManagementSystem:Sensor,
    School_SensibleHeatLoss,     !- Name
    school,                      !- Output:Variable or Output:Meter Index Key Name
    Zone Mixing Sensible Heat Loss Energy;  !- Output:Variable or Output:Meter Name

EnergyManagementSystem:Sensor,
    School_HeatingLoad,          !- Name
    school,                      !- Output:Variable or Output:Meter Index Key Name
    Zone Air System Sensible Heating Rate;  !- Output:Variable or Output:Meter Name


EnergyManagementSystem:Sensor,
    Sunspace_Temp,               !- Name of the sensor for sunspace
    sunspace,                    !- Output:Variable or Output:Meter Index Key Name
    Zone Mean Air Temperature;    !- Output:Variable or Output:Meter Name

EnergyManagementSystem:Sensor,
    School_Temp,                 !- Name of the sensor for school
    school,                      !- Output:Variable or Output:Meter Index Key Name
    Zone Mean Air Temperature;    !- Output:Variable or Output:Meter Name



EnergyManagementSystem:Actuator,
    SeasonalMixSchedule,         !- Name
    SEASONAL_SCHEDULE,           !- Actuated Component Unique Name
    Schedule:Compact,            !- Actuated Component Type
    Schedule Value;              !- Actuated Component Control Type





EnergyManagementSystem:ProgramCallingManager,
    ApplyMixingControlManager,   !- Name
    AfterPredictorAfterHVACManagers,  !- EnergyPlus Model Calling Point
    MyMixingControlProgram;      !- Program Name 1

ZoneCrossMixing,
    MyMixObj,                    !- Name
    school,                      !- Zone Name
    SEASONAL_SCHEDULE,           !- Schedule Name
    AirChanges/Hour,             !- Design Flow Rate calculation method
    ,                         !- Design Flow Rate {m3/s}
    ,                            !- Flow Rate per Area {m3/s/m2}
    ,                            !- Flow Rate per Person {m3/s/person}
    20,                          !- Air Changes Per Hour
    sunspace,                    !- Source Zone Name
    0;                           !- Delta temp

Output:Variable,
    school,                      !- Key Value
    Zone Mixing Sensible Heat Loss Energy,  !- Variable Name
    Timestep;                    !- Reporting Frequency


Output:Variable,
    school,                      !- Key Value
    Zone Mixing Sensible Heat Gain Energy,  !- Variable Name
    Timestep;                    !- Reporting Frequency

Output:Variable,
    school,                      !- Key Value
    Zone Air System Sensible Heating Rate, !- Variable Name
    Timestep;                    !- Reporting Frequency

Output:Variable,
    school,                      !- Key Value
    Zone Cross Mixing Volume Flow Rate,  !- Variable Name
    Timestep;                    !- Reporting Frequency

Output:Variable,
    sunspace,                    !- Key Value
    Zone Cross Mixing Volume Flow Rate,  !- Variable Name
    Timestep;                    !- Reporting Frequency

Output:EnergyManagementSystem,
    Verbose,                     !- Actuator Availability Dictionary Reporting
    Verbose,                     !- Internal Variable Availability Dictionary Reporting
    Verbose;                     !- EMS Runtime Language Debug Output Level

EnergyManagementSystem:OutputVariable,
    EMS_SeasonalMixSchedule,     !- Name
    SeasonalMixSchedule,         !- EMS Variable Name
    Averaged,                    !- Type of Data in Variable
    ZoneTimeStep;                !- Update Frequency

Output:Variable,
    SEASONAL_SCHEDULE,           !- Key Value
    Schedule Value,              !- Variable Name
    Timestep;                    !- Reporting Frequency

Output:Variable,
    school,                        !- Key Value
    Zone Mean Air Temperature, !- Variable Name
    Timestep;                   !- Reporting Frequency


ScheduleTypeLimits,
    On/Off,                      !- Name
    0,                           !- Lower Limit Value
    1,                           !- Upper Limit Value
    Discrete,                    !- Numeric Type
    ;""")
larger_than_4 = LargerThan(FirstNumber=addition, SecondNumber=0)  # -> LargerThan, OrEqualTo
stream_filter_10 = StreamFilter(Gate=larger_than_4.LargerThan, Stream1=[ems_calling_and_control, panel_29, panel_28])

panel_30 = Panel(ghpython_script_3.a)
panel_31 = Panel(ghpython_script_4.a)
stream_filter_11 = StreamFilter(Gate=larger_than_4.LargerThan, Stream1=panel_30)

toggle = BooleanToggle(True)
simoutput = HBSimulationOutput(zone_energy_use=toggle, gains_and_losses=toggle, surface_energy_flow=toggle, report_frequency="Timestep")  # -> report, sim_output; plug-in component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
shadowcalc = HBShadowCalculation(solar_dist="4", update_method="Timestep")  # -> shadow_calc; plug-in component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
simcontrol = HBSimulationControl(do_zone_sizing="False", do_system_sizing="False", do_plant_sizing="False", for_sizing_period="False")  # -> sim_control; plug-in component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
analysisperiod_3 = LBAnalysisPeriod(start_month=1, start_day=1, start_hour=0, timestep="1")  # -> period, hoys, dates; plug-in component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
customoutput = HBCustomSimulationOutput(base_sim_output=simoutput.sim_output)  # -> report, sim_output; plug-in component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
simpar = HBSimulationParameter(
    output=customoutput.sim_output,
    run_period=analysisperiod_3.period,
    timestep="1",
    sim_control=simcontrol,
    shadow_calc=shadowcalc)  # -> sim_par; plug-in component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

epw_file = ClusterInput()
write = ClusterInput()
run = ClusterInput()
file_path = FilePath("C:\Users\amomenae\Desktop\PFI_meetings\dir\")
larger_than_5 = LargerThan(FirstNumber=addition, SecondNumber=0)  # -> LargerThan, OrEqualTo
B_3 = ClusterInput()
integer = Integer(larger_than_5.LargerThan)
multiplication_4 = Multiplication(A=integer, B=B_3)
gate_3 = ClusterInput()

surface = Surface(vizquick_2)
surface_2 = Surface(scale.Geometry)
aperture_2 = HBAperture(geo=surface_2, name="vertical_window", operable=boolean_toggle, ep_constr=windowconstr_2)  # -> out, apertures; plug-in component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

flip_2 = Flip(Surface=surface, Guide=move_2.Geometry)  # -> Surface, Result

aperture_3 = HBAperture(geo=flip_2.Surface, name="skylight_window", ep_constr=windowconstr)  # -> out, apertures; plug-in component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

id_15 = HBSetIdentifier(hb_obj=aperture_3.apertures, id="skylight_window")  # -> hb_obj; plug-in component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
id_16 = HBSetIdentifier(hb_obj=aperture_2.apertures, id="vertical_window")  # -> hb_obj; plug-in component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
relay_7 = Relay([id_15, id_16, aperture.apertures])
stream_filter_12 = StreamFilter(Gate=null_item.NullFlags, Stream0=relay_7, Stream1=aperture.apertures)
addsubface = HBAddSubface(hb_obj=flatten(stream_filter_5), sub_faces=flatten(stream_filter_12))  # -> hb_obj; plug-in component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
solveadj_2 = HBSolveAdjacency(rooms=flatten(addsubface), run=Toggle(True))  # -> report, adj_rooms; plug-in component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

# ---- group: dimension
colour = ColourPicker(PickedColour=RGB(235, 235, 235))
number_slider_2 = Slider(1, range=0..10)
colour_2 = ColourPicker(PickedColour=RGBA(38, 138, 166, 192))
unit_y = UnitY(Factor=number_slider_2)
unit_x = UnitX(Factor=number_slider_2)
vizbytype = HBVisualizeByType(hb_objs=solveadj_2.adj_rooms)  # -> walls, interior_walls, roofs, ceilings, exterior_floors, interior_floors, air_walls, apertures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; plug-in component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
addition_3 = Addition(A=unit_y, B=unit_x)
explode_4 = Explode(Curve=rectangle.Rectangle, Recursive=True)  # -> Segments, Vertices
mesh = Mesh(vizbytype.walls)
mesh_2 = Mesh(vizbytype.interior_walls)
mesh_3 = Mesh(vizbytype.roofs)
mesh_4 = Mesh([vizbytype.interior_apertures, vizbytype.apertures])
amplitude_2 = Amplitude(Vector=addition_3, Amplitude=Slider(1, range=0..10))
list_item_38 = ListItem(List=deconstruct_brep.Edges, Index="-2", Wrap=True)
list_item_39 = ListItem(List=explode_4.Segments, Index=0, Wrap=True)  # -> Item, Item1, Item2
end_points_2 = EndPoints(Curve=list_item_38)  # -> Start, End
move_4 = Move(Geometry=list_item_38, Motion=amplitude_2)  # -> Geometry, Transform
number_slider_3 = Slider(0.5, range=0..1)
end_points_3 = EndPoints(Curve=list_item_39.Item2)  # -> Start, End
move_5 = Move(Geometry=list_item_39.Item1, Motion=unit_x)  # -> Geometry, Transform
end_points_4 = EndPoints(Curve=list_item_39.Item1)  # -> Start, End
move_6 = Move(Geometry=offset_curve_loose, Motion=unit_y)  # -> Geometry, Transform

# ----
colour_3 = ClusterOutput(colour)
colour_4 = ClusterOutput(colour_2)
mesh_5 = ClusterOutput(mesh)
mesh_6 = ClusterOutput(mesh_2)
mesh_7 = ClusterOutput(mesh_3)
mesh_8 = ClusterOutput(mesh_4)
start = ClusterOutput(end_points_2.Start)
end = ClusterOutput(end_points_2.End)
geometry = ClusterOutput(move_4.Geometry)
start_2 = ClusterOutput(end_points_3.Start)
end_2 = ClusterOutput(end_points_3.End)
start_3 = ClusterOutput(end_points_4.Start)
end_3 = ClusterOutput(end_points_4.End)
number_slider_4 = ClusterOutput(number_slider_3)
geometry_2 = ClusterOutput(move_5.Geometry)
geometry_3 = ClusterOutput(move_6.Geometry)
adj_rooms = ClusterOutput(solveadj_2.adj_rooms)
addshade = HBAddShade(hb_obj=solveadj_2.adj_rooms, out_shades=flatten(shade.shades))  # -> hb_obj; plug-in component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
idealair = HBIdealAir(rooms=flatten(addshade), economizer="Noeconomizer", heat_limit="NoLimit", cool_limit="NoLimit")  # -> out, rooms; plug-in component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
model = HBModel(rooms=flatten(idealair.rooms), name="a")  # -> out, model; plug-in component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
modeltoosm = HBModelToOSM(
    model=model.model,
    epw_file=epw_file,
    sim_par=simpar,
    add_str=flatten([stream_filter_11, panel_31, panel_21, panel_20, panel_22, panel_23, relay_6, co2, stream_filter_10, panel_25, panel_24, stream_filter_9, co2_2]),
    folder=file_path,
    write=write,
    run=run)  # -> report, jsons, osw, osm, idf, sql, zsz, rdd, html; plug-in component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
roomenergyresult = HBReadRoomEnergyResult(sql=modeltoosm.sql)  # -> cooling, heating, lighting, electric_equip, gas_equip, process, hot_water, fan_electric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; plug-in component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
normbyflr = HBNormalizeByFloorArea(data=roomenergyresult.cooling, model=model.model)  # -> total_data, room_data; plug-in component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
normbyflr_2 = HBNormalizeByFloorArea(data=roomenergyresult.heating, model=model.model)  # -> total_data, room_data; plug-in component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
xdata = LBDeconstructData(data=roomenergyresult.heating)  # -> header, values; plug-in component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
xdata_2 = LBDeconstructData(data=roomenergyresult.solar_gain)  # -> header, values; plug-in component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
xdata_3 = LBDeconstructData(data=normbyflr.room_data)  # -> header, values; plug-in component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
xdata_4 = LBDeconstructData(data=normbyflr_2.room_data)  # -> header, values; plug-in component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
ma = MassAddition(Input=xdata.values)  # -> flatten(Result), PartialResults
ma_2 = MassAddition(Input=xdata_2.values)  # -> flatten(Result), PartialResults
list_item_40 = ListItem(List=ma_2.Result, Index=0, Wrap=True)  # -> Item, Item1
list_item_41 = ListItem(List=ma.Result, Index=0, Wrap=True)  # -> Item, Item1
ma_3 = MassAddition(Input=xdata_4.values)  # -> flatten(Result), PartialResults
ma_4 = MassAddition(Input=xdata_3.values)  # -> flatten(Result), PartialResults
item_1 = ClusterOutput(list_item_40.Item1)
list_item_42 = ListItem(List=flatten(ma_4.Result), Index=0, Wrap=True)  # -> Item, Item1
list_item_43 = ListItem(List=flatten(ma_3.Result), Index=0, Wrap=True)  # -> Item, Item1
stream_filter_13 = StreamFilter(Gate=gate_3, Stream0="0", Stream1=list_item_42.Item)
stream_filter_14 = StreamFilter(Gate=multiplication_4, Stream0=list_item_43.Item, Stream1="0")
s_0 = ClusterOutput(stream_filter_13)
s_0_2 = ClusterOutput(stream_filter_14)
